# Dynamo graph TopoEditSample.dyn (Dynamo 2.3.1.11775)

select_edge = DSEdgeSelection()  # 1 picked in the model
code_block = CodeBlock { [0,0.5,1]; }
pointAtParameter = Curve.PointAtParameter(curve=select_edge, param=code_block)
select_topo = DSModelElementSelection()  # 1 picked in the model
points = Topography.Points(topography=select_topo)
closestPointTo = Geometry.ClosestPointTo(geometry=select_edge, other=points@L2)
flatten = List.Flatten(list=closestPointTo)
byStartPointEndPoint = Line.ByStartPointEndPoint(startPoint=flatten, endPoint=points)
direction = Line.Direction(line=byStartPointEndPoint)
normalized = Vector.Normalized(vector=direction)
code_block_2 = CodeBlock(a=normalized) { Math.Abs(a.Z)>0.9; }
boolean = BoolSelector(true)
allIndicesOf = List.AllIndicesOf(list=code_block_2, item=boolean)

# group: To be added
getItemAtIndex = List.GetItemAtIndex(list=flatten, index=allIndicesOf)

append_or_move = BoolSelector(true)
code_block_3 = CodeBlock(trueval=pointAtParameter, falseval=getItemAtIndex, test=append_or_move) { result = [trueval, falseval]; result[test ? 0 : 1]; }

# group: To be removed
getItemAtIndex_2 = List.GetItemAtIndex(list=points, index=allIndicesOf)

isNull = Object.IsNull(obj=getItemAtIndex_2)
code_block_4 = CodeBlock(falseval=getItemAtIndex_2, test=isNull) { result = [trueval, falseval]; result[test ? 0 : 1]; }  # unwired: trueval
flatten_2 = List.Flatten(list=code_block_4.out1)
python_script = Python(IN[0]=code_block_3.out1, IN[1]=flatten_2, IN[2]=select_topo, IN[3]=append_or_move)
# ---------- python_script.python (87 lines) ----------
#Update Topo(Append or Move Point)
#Created By DY Lim - dylim@tssni.com
#Inspired By Karam Baki : karam@aecedx.com

import clr
clr.AddReference('ProtoGeometry')
from Autodesk.DesignScript import Geometry as dg

# EXTENSION Enable ToDSType
clr.AddReference('RevitNodes')
import Revit
clr.ImportExtensions(Revit.Elements)

# Enable Revit Elements
from Revit.Elements import *

# EXTENSION Enable Geometry Conversion Methods
clr.ImportExtensions(Revit.GeometryConversion)

# Enable Revit API
clr.AddReference('RevitAPI')
from Autodesk.Revit.DB import *
import Autodesk.Revit.DB
# Enable DocumentManager and TransactionManager
clr.AddReference('RevitServices')
from RevitServices.Persistence import DocumentManager
from RevitServices.Transactions import TransactionManager

# Enable ICollection List Translate
clr.AddReference("System")
import System.Collections.Generic
from System.Collections.Generic import List
doc = DocumentManager.Instance.CurrentDBDocument
uidoc = DocumentManager.Instance.CurrentUIApplication.ActiveUIDocument
uiapp = DocumentManager.Instance.CurrentUIApplication
app = uiapp.Application

class WarnSwallow(IFailuresPreprocessor):
	def PreprocessFailures(self, failuresAccessor):
		failuresAccessor.DeleteAllWarnings()
		return FailureProcessingResult.Continue

def append_point(pts_added,topoid):
    Revit.Transaction.Transaction.End(doc)
    editsession.Start(topoid)
    TransactionManager.Instance.EnsureInTransaction(doc)
    topo.AddPoints(pts_added)
    TransactionManager.Instance.ForceCloseTransaction()
    editsession.Commit(failproc)

def remove_point(pts_removed,topoid):
    Revit.Transaction.Transaction.End(doc)
    editsession.Start(topoid)
    TransactionManager.Instance.EnsureInTransaction(doc)
    topo.DeletePoints(pts_remove)
    TransactionManager.Instance.ForceCloseTransaction()
    editsession.Commit(failproc)

#####################################################################
#Data Input
dataEnteringNode = IN
# Use UnwrapElement(IN[0]) When Translating From Dynamo to Revit
pts_new = [i.ToXyz() for i in UnwrapElement(IN[0])]
pts_remove = [i.ToXyz() for i in UnwrapElement(IN[1])]
topo = UnwrapElement(IN[2])
append_or_move=IN[3]
#Data Input
#####################################################################

#For Topo Edit Scope
failproc = WarnSwallow()
editsession = Architecture.TopographyEditScope(doc,"Main Session")
editsessioncl = Architecture.TopographyEditScope(doc,"Clean Up Session")
topo_id=topo.Id

#append point if true or move point to closest edge point
if append_or_move == True:
    append_point(pts_new,topo_id)
elif append_or_move == False:
    append_point(pts_new,topo_id)
    remove_point(pts_remove,topo_id)

###################
#Data Output
OUT = topo
#Data Output
###################
# ----------------------------------------
