# Dynamo graph CurvedSectionByAlignment.dyn (Dynamo 2.3.1.11775)
# packages: Data-Shapes 2021.2.91, archi-lab.net 2021.25.16

# group: Read me
# note: Author-DY Lim
# First release on April 2022
# note: Used Packages :
# -Data-Shapes 2021.2.91
# -archi-lab.net 2021.25.16
# note: Tested under :
# Revit 2020.2.8
# Dynamo 2.3.1
# note: Please read the instruction before use.

# group: Stage 1
flip_section = BoolSelector(true)
# note: The lower number of point shows better quality but results worse performance
# note: Preview of Start Point Chainage is two blue squares on alignment
create_views = BoolSelector(false)
# note: Section direction will point on left of alignment direction.
# Negative figure of Offset will point opposite direction.
offset_from_alignment = DoubleInput(0)
flip_start_chainage_point = BoolSelector(false)
select_model_elements = DSModelElementsSelection()  # 1 picked in the model
end = DoubleInput(10000)
start = DoubleInput(0)
number_of_point = DoubleSlider(30, range=1..500 step 1)
view_templates = ViewTemplatesUi("set")

# group: Split Segment from Alignment
code_block = CodeBlock(modelcrv=select_model_elements) { PolyCurve.ByJoinedCurves(List.Flatten(modelcrv.Curves)); }
reverse = Curve.Reverse(curve=code_block)
code_block_2 = CodeBlock(FilpAlignment=flip_start_chainage_point, reverse=reverse, original=code_block) { FilpAlignment?reverse:original; }
code_block_3 = CodeBlock(alignment=code_block_2) { alignment; }
code_block_4 = CodeBlock(end=end, start=start, num=number_of_point) { interval_length=(end-start)/num; set=start..end..interval_length; }
code_block_5 = CodeBlock(set=code_block_4.set, num=number_of_point, end=end) { List.Count(set)==(num+1)?set:List.AddItemToEnd(end,set); }
pointAtSegmentLength = Curve.PointAtSegmentLength(curve=code_block_3, segmentLength=code_block_5)
code_block_6 = CodeBlock(a=code_block_3) { a.Length; }

# group: Project Point to Elements
code_block_7 = CodeBlock { 200000; }
translate = Geometry.Translate(geometry=pointAtSegmentLength, zTranslation=code_block_7)
code_block_8 = CodeBlock { Vector.ByCoordinates(0,0,-1); Application.Document.ActiveView(Application.Document.Current); false; }
raybounce_on_linked_model = Custom[RayBounce On Linked Model](Points=translate, Direction=code_block_8.out0, ThreeDView=code_block_8.out1, BounceOnLinkOnly=code_block_8.out2)  # package Data-Shapes; Same functionality as raybounce but takes linked model elements into account

# group: Check projected points whether projected all or failed
uniqueItems = List.UniqueItems(list=raybounce_on_linked_model.Elements)
clean = List.Clean(list=uniqueItems, preserveIndices=code_block_8.out2)
type = Object.Type(obj=clean)
code_block_9 = CodeBlock { "Revit.Elements.ModelCurve"; }
contains = List.Contains(list=type, item=code_block_9)
isNull = Object.IsNull(obj=uniqueItems)
countTrue = List.CountTrue(list=isNull)
code_block_10 = CodeBlock(n=countTrue) { n > 0; }
or_ = Or(bool0=contains, bool1=code_block_10)
code_block_11 = CodeBlock(targetnotfound=or_, defaultpoint=pointAtSegmentLength, targetpoint=raybounce_on_linked_model.Points) { targetnotfound?defaultpoint:targetpoint; }

# group: Set Section Width and Perpendiculer Offset
byPoints = NurbsCurve.ByPoints(points=code_block_11)
parameterAtPoint = Curve.ParameterAtPoint(curve=byPoints, point=code_block_11)
tangentAtParameter = Curve.TangentAtParameter(curve=byPoints, param=parameterAtPoint)
flatten = List.Flatten(list=tangentAtParameter)
normalAtParameter = Curve.NormalAtParameter(curve=byPoints, param=parameterAtPoint)
flatten_2 = List.Flatten(list=normalAtParameter)
code_block_12 = CodeBlock(tan=flatten, nor=flatten_2) { Vector.Cross(tan,nor).Z>0?nor:Vector.Reverse(nor); }
scale = Vector.Scale(vector=code_block_12, scale_factor=offset_from_alignment)
add = Point.Add(point=code_block_11, vectorToAdd=scale)
code_block_13 = CodeBlock(isoffsetzero=offset_from_alignment, pts=code_block_11, offset_pts=add) { isoffsetzero==0?pts:offset_pts; }
code_block_14 = CodeBlock(pts=code_block_13) { List.DropItems(List.Sublists(List.Flatten(pts),0..1,1),-1); }
deconstruct = List.Deconstruct(list=code_block_14@L2)
byStartPointEndPoint = Line.ByStartPointEndPoint(startPoint=deconstruct.first, endPoint=deconstruct.rest)
reverse_2 = Curve.Reverse(curve=byStartPointEndPoint)
code_block_15 = CodeBlock(reverse=flip_section, reversedline=reverse_2, line=byStartPointEndPoint) { reverse?reversedline:line; }
code_block_16 = CodeBlock { 0.5; }
planeAtParameter = Curve.PlaneAtParameter(curve=byPoints, param=parameterAtPoint)
code_block_17 = CodeBlock { 300; 500; }
byWidthLength = Rectangle.ByWidthLength(plane=planeAtParameter, width=code_block_17.out0, length=code_block_17.out1)

view_depth = DoubleInput(100)

# group: Set Section View Depth and Width
pointAtParameter = Curve.PointAtParameter(curve=code_block_15, param=code_block_16)
code_block_18 = CodeBlock(midpts=pointAtParameter)
# ---------- code_block_18.designscript (5 lines) ----------
min=List.MinimumItem(List.Flatten(midpts.Z))-1000;
max=List.MaximumItem(List.Flatten(midpts.Z))+1000;
mid=(max+min)/2;
down=-(mid-min)-1000;
up=max-mid+1000;
# ----------------------------------------
normalAtParameter_2 = Curve.NormalAtParameter(curve=code_block_15, param=code_block_16)
code_block_19 = CodeBlock(stp=deconstruct.first, enp=deconstruct.rest, mdp=pointAtParameter)
# ---------- code_block_19.designscript (6 lines) ----------
zero_start=Point.ByCoordinates(stp.X,stp.Y,0);
zero_end=Point.ByCoordinates(enp.X,enp.Y,0);
zero_mid=Point.ByCoordinates(mdp.X,mdp.Y,0);

-(Geometry.DistanceTo(zero_mid,zero_start));
Geometry.DistanceTo(zero_mid,zero_end);
# ----------------------------------------
byCoordinates = Point.ByCoordinates(x=code_block_19.out3, y=code_block_18.down)
code_block_20 = CodeBlock(targetnotfound=or_, pts_projected=raybounce_on_linked_model.Points, up=code_block_18.up) { targetnotfound?List.MaximumItem(pts_projected.Z)*2:up; }

# group: Stage 2
# note: Sheet Number must be unique.
sheet_name = StringInput("LongSection")
sheet_number = StringInput("100")
family_types = FamilyTypes("TitileBlock_CurvedSection:TitileBlock_CurvedSection")
# note: Title Block must be specified.
create_sheet = BoolSelector(false)
auto_drawing_height = BoolSelector(true)
manual_drawing_height = DoubleInput(0)
current_auto_drawing_height = Watch(code_block_20)

# group: Set Custom Coordination System based on section line
code_block_21 = CodeBlock(a=pointAtParameter, midZ=code_block_18.mid) { Point.ByCoordinates(a.X,a.Y,midZ); }
direction = Line.Direction(line=code_block_15)
normalized = Vector.Normalized(vector=direction)
reverse_3 = Vector.Reverse(vector=normalized)
code_block_22 = CodeBlock(a=reverse_3) { Vector.ByCoordinates(a.X,a.Y); }
ZAxis = Vector.ZAxis()
reverse_4 = Vector.Reverse(vector=normalAtParameter_2)
byOriginVectors = CoordinateSystem.ByOriginVectors(origin=code_block_21, xAxis=code_block_22, yAxis=ZAxis, zAxis=reverse_4)
code_block_23 = CodeBlock(pass=create_views, cs=byOriginVectors) { pass?cs:""; }

code_block_24 = CodeBlock(auto=auto_drawing_height, val=code_block_20, manualval=manual_drawing_height) { auto?val:manualval; }

# group (continued): Set Section View Depth and Width
byCoordinates_2 = Point.ByCoordinates(x=code_block_19.out4, y=code_block_24, z=view_depth)

# group: StartPoint Preview
code_block_25 = CodeBlock { 0; }
planeAtParameter_2 = Curve.PlaneAtParameter(curve=code_block_3, param=code_block_25)
code_block_26 = CodeBlock { 100; 300; }
byWidthLength_2 = Rectangle.ByWidthLength(plane=planeAtParameter_2, width=code_block_26.out0, length=code_block_26.out1)
code_block_27 = CodeBlock(pts=pointAtSegmentLength) { pts[0]; }
ZAxis_2 = Vector.ZAxis()
normalAtParameter_3 = Curve.NormalAtParameter(curve=code_block_3, param=code_block_25)
byOriginNormalXAxis = Plane.ByOriginNormalXAxis(origin=code_block_27, normal=ZAxis_2, xAxis=normalAtParameter_3)
byWidthLength_3 = Rectangle.ByWidthLength(plane=byOriginNormalXAxis, width=code_block_26.out0, length=code_block_26.out1)

# group (continued): Stage 1
alignment_length = Watch(code_block_6)
interval_length = Watch(code_block_4.interval_length)

section_name = StringInput("")

# group: Create Section Views and set properties
byCoordinateSystemMinPointMaxPoint = SectionView.ByCoordinateSystemMinPointMaxPoint(cs=code_block_23, minPoint=byCoordinates, maxPoint=byCoordinates_2)
flatten_3 = List.Flatten(list=byCoordinateSystemMinPointMaxPoint)
reverse_5 = List.Reverse(list=flatten_3)
code_block_28 = CodeBlock(flip=flip_section, ReverseList=reverse_5, NormalList=flatten_3) { flip?ReverseList:NormalList; }
setViewTemplate = archilab.Revit.Views.Views.SetViewTemplate(view=code_block_28, viewTemplate=view_templates)
code_block_29 = CodeBlock(views=code_block_28) { view_cnt=List.Count(views); viewprefix+"_"+(0..view_cnt); }  # unwired: viewprefix
code_block_30 = CodeBlock { "View Name"; }
setParameterByName = Element.SetParameterByName(parameterName=code_block_30, value=section_name)  # unwired: element
code_block_31 = CodeBlock(interval=code_block_19.out4) { interval; }
code_block_32 = CodeBlock { "Scale Value    1:"; }
getParameterValueByName = Element.GetParameterValueByName(element=code_block_28, parameterName=code_block_32)

# group: Create Sheet
code_block_33 = CodeBlock(pass=create_sheet, views=setViewTemplate) { pass?views:""; }
byNameNumberTitleBlockAndViews = Sheet.ByNameNumberTitleBlockAndViews(sheetName=sheet_name, sheetNumber=sheet_number, titleBlockFamilyType=family_types, views=code_block_33)
code_block_34 = CodeBlock(views=setViewTemplate) { views[0]; }
isNull_2 = Object.IsNull(obj=code_block_34)
code_block_35 = CodeBlock(a=view_templates) { a.Name; }
code_block_36 = CodeBlock(viewtemplate=isNull_2, templatename=code_block_35) { viewtemplate?"Error:Create New Viewplate for Sections":templatename+" template has applied"; }

# group: View Depth Preview
reverse_6 = Vector.Reverse(vector=normalAtParameter_2)
byStartPointDirectionLength = Line.ByStartPointDirectionLength(startPoint=pointAtParameter, direction=reverse_6, length=view_depth)

# group (continued): Stage 1
watch = Watch(code_block_36)

# group: Preview Offset Points
watch_2 = Watch(code_block_13)

# group: Preview Offset Section Line
watch_3 = Watch(code_block_15)
