# Dynamo graph HermiteTransform.dyn (Dynamo 2.3.2.15696)

select_model_elements = DSModelElementsSelection()  # 113 picked in the model
point = ReferencePoint.Point(referencePoint=select_model_elements)
select_model_element = DSModelElementSelection()  # 1 picked in the model
code_block = CodeBlock(a=select_model_element) { a.Curves; }
code_block_2 = CodeBlock { 0..1000000..#100; }
pointAtSegmentLength = Curve.PointAtSegmentLength(curve=code_block@L1, segmentLength=code_block_2)
flatten = List.Flatten(list=pointAtSegmentLength)
convert_between_units = DynamoConvert(code_block_2, MeasurementType="Length", FromConversion="Millimeters", ToConversion="Feet")
python_script = Python(IN[0]=select_model_element, IN[1]=convert_between_units)
# ---------- python_script.python (42 lines) ----------
# Load the Python Standard and DesignScript Libraries
import sys
import clr
clr.AddReference('ProtoGeometry')
from Autodesk.DesignScript.Geometry import *
clr.AddReference("RevitAPI")
from Autodesk.Revit import DB
clr.AddReference("RevitServices")
import RevitServices
from RevitServices.Persistence import DocumentManager

doc = DocumentManager.Instance.CurrentDBDocument
uiapp = DocumentManager.Instance.CurrentUIApplication
app = uiapp.Application

# The inputs to this node will be stored as a list in the IN variables.
dataEnteringNode = IN
a = UnwrapElement(IN[0])
len = IN[1]
op = DB.Options()
op.ComputeReferences = True
op.IncludeNonVisibleObjects = False
op.View = doc.ActiveView
geo = a.get_Geometry(op)
geo = [g for g in geo]
nor = []
for l in len:
	nor.append(geo[0].ComputeDerivatives(l, False))

out = []
res = [[n.BasisX, n.BasisY, n.BasisZ] for n in nor]
#res = [n.BasisY for n in nor]
for r in res:
	for rr in r:
		out.append([rr.X,rr.Y,rr.Z])
#for r in res:
#	out.append([r.X,r.Y,r.Z])

# Place your code below this line

# Assign your output to the OUT variable.
OUT = out
# ----------------------------------------
code_block_3 = CodeBlock { 0; }
getItemAtIndex = List.GetItemAtIndex(list=python_script@L2, index=code_block_3)
code_block_4 = CodeBlock { 1; }
getItemAtIndex_2 = List.GetItemAtIndex(list=python_script@L2, index=code_block_4)
code_block_5 = CodeBlock { 2; }
getItemAtIndex_3 = List.GetItemAtIndex(list=python_script@L2, index=code_block_5)
code_block_6 = CodeBlock(x=getItemAtIndex, y=getItemAtIndex_2, z=getItemAtIndex_3) { Vector.ByCoordinates(x,y,z); }
code_block_7 = CodeBlock { 3; }
chop = List.Chop(list=code_block_6, lengths=code_block_7)
code_block_8 = CodeBlock { 0; }
getItemAtIndex_4 = List.GetItemAtIndex(list=chop@L2, index=code_block_8)
code_block_9 = CodeBlock { 5000; }
byStartPointDirectionLength = Line.ByStartPointDirectionLength(startPoint=flatten, direction=getItemAtIndex_4, length=code_block_9)
convert_between_units_2 = DynamoConvert(code_block_2, MeasurementType="Length", FromConversion="Feet", ToConversion="Millimeters")
code_block_10 = CodeBlock { 1; }
getItemAtIndex_5 = List.GetItemAtIndex(list=chop@L2, index=code_block_10)
code_block_11 = CodeBlock(a=getItemAtIndex_5) { Vector.ByCoordinates(a.X,a.Y,0); }
byStartPointDirectionLength_2 = Line.ByStartPointDirectionLength(startPoint=flatten, direction=code_block_11, length=code_block_9)
