# Dynamo graph Create - Alignment and Offset.dyn "CreateAlignment" (Dynamo 2.3.1.11775)
# packages: Data-Shapes 2021.2.91, Clockwork for Dynamo 2.x 2.3.0

filepath_data = Custom[FilePath Data]()  # package Data-Shapes; Create filepath input for UI.MultipleInputForm ++ . Check out www.data-shapes.net for more infos !
code_block = CodeBlock { "Alignment \nSheet Name"; }
string = StringInput("Alignment")
textbox_data = Custom[TextBox Data](InputName=code_block, DefaultText=string)  # package Data-Shapes; Create Data for TextBox input in UI.MultipleInputForm ++ . Check out www.data-shapes.net for more informations
code_block_2 = CodeBlock { "General Points \nSheet Name"; }
string_2 = StringInput("General")
textbox_data_2 = Custom[TextBox Data](InputName=code_block_2, DefaultText=string_2)
code_block_3 = CodeBlock { "Optional Points \nSheet Name"; }
string_3 = StringInput("Optional")
textbox_data_3 = Custom[TextBox Data](InputName=code_block_3, DefaultText=string_3)
code_block_4 = CodeBlock { "Vertical Curve \nSetting"; }
string_4 = StringInput("Vertical Curve")
textbox_data_4 = Custom[TextBox Data](InputName=code_block_4, DefaultText=string_4)
join = List.Join(list0=filepath_data, list1=textbox_data, list2=textbox_data_2, list3=textbox_data_3, list4=textbox_data_4)
boolean = BoolSelector(true)
code_block_5 = CodeBlock { 500; }
multipleinputform = Custom[MultipleInputForm ++](Inputs=join, Toggle=boolean, Width_optional=code_block_5)  # package Data-Shapes; Create a form with multiple inputs. see www.data-shapes.net for tutorials and infos!
firstItem = List.FirstItem(list=multipleinputform.User_Inputs)
file_from_path = FileObject(path=firstItem)
code_block_6 = CodeBlock(sheetname=multipleinputform.User_Inputs) { sheetname[1]; sheetname[2]; sheetname[3]; sheetname[4]; }
importExcel = Data.ImportExcel(file=file_from_path, sheetName=code_block_6.out0)
restOfItems = List.RestOfItems(list=importExcel)
transpose = List.Transpose(lists=restOfItems)
restOfItems_2 = List.RestOfItems(list=transpose)
code_block_7 = CodeBlock(data=restOfItems_2)
# ---------- code_block_7.designscript (4 lines) ----------
Point.ByCoordinates(data[0],data[1],0);
Vector.Normalized(Vector.ByCoordinates(data[2],data[3],0));
station = data[4];
dist = data[5];
# ----------------------------------------
importExcel_2 = Data.ImportExcel(file=file_from_path, sheetName=code_block_6.out1)
restOfItems_3 = List.RestOfItems(list=importExcel_2)
transpose_2 = List.Transpose(lists=restOfItems_3)
code_block_8 = CodeBlock { "Placement Point?"; }
firstItem_2 = List.FirstItem(list=importExcel_2)
code_block_9 = CodeBlock(data=importExcel_2) { List.AllIndicesOf(List.FirstItem(data),"SubPoint")+1; }
getItemAtIndex = List.GetItemAtIndex(list=firstItem_2, index=code_block_9)
dropdown_data = Custom[DropDown Data](InputName=code_block_8, Keys=getItemAtIndex, Values=code_block_9)  # package Data-Shapes; Create data for DropDown input in UI.MultiInputForm ++ . Check out www.data-shapes.net for more infos.
code_block_10 = CodeBlock { "Inner Edge?"; }
dropdown_data_2 = Custom[DropDown Data](InputName=code_block_10, Keys=getItemAtIndex, Values=code_block_9)
code_block_11 = CodeBlock { "Outer Edge?"; }
dropdown_data_3 = Custom[DropDown Data](InputName=code_block_11, Keys=getItemAtIndex, Values=code_block_9)
join_2 = List.Join(list0=dropdown_data, list1=dropdown_data_2, list2=dropdown_data_3)
multipleinputform_2 = Custom[MultipleInputForm ++](Inputs=join_2, Toggle=multipleinputform.Was_Run)
getItemAtIndex_2 = List.GetItemAtIndex(list=transpose_2, index=multipleinputform_2.User_Inputs)
code_block_12 = CodeBlock(data=getItemAtIndex_2)
# ---------- code_block_12.designscript (6 lines) ----------
data[0];
//placement;
data[1];
//inner;
data[2];
//outer;
# ----------------------------------------
flatten = List.Flatten(list=code_block_12.out0)
scale = Vector.Scale(vector=code_block_7.out1, scale_factor=flatten)
add = Point.Add(point=code_block_7.out0, vectorToAdd=scale)
importExcel_3 = Data.ImportExcel(file=file_from_path, sheetName=code_block_6.out3)
restOfItems_4 = List.RestOfItems(list=importExcel_3)
transpose_3 = List.Transpose(lists=restOfItems_4)

# group: Calculate elevation and slope
python_script = Python(IN[0]=transpose_3, IN[1]=code_block_7.station)
# ---------- python_script.python (129 lines) ----------
# Load the Python Standard and DesignScript Libraries
import sys
import clr
clr.AddReference('ProtoGeometry')
from Autodesk.DesignScript.Geometry import *

# The inputs to this node will be stored as a list in the IN variables.
dataEnteringNode = IN
data = IN[0]

for index, item in enumerate(data[1]):
    if data[1][index] == data[1][index+1]:
        range=index+1
        break

# Place your code below this line
length = data[0][0:range]
pviElevation = data[1][0:range]
pviStation = data[2][0:range]
slope = data[3][0:range]
superElevationStation = data[4]
superElevation = data[5]

_stationStart =superElevationStation[0]
_stationEnd = superElevationStation[-1]
_CurveType = []
_CurveLength = []

target = [(item*0.001) + _stationStart for item in IN[1]]

def accumulate(list):
    total = 0
    for x in list:
        total += x
        yield total
            

def RangeTypeAtStation(stations, curvelength, accumulationrequired=True):
    group = []
    if accumulationrequired:
        accumulatedLength = list(accumulate(curvelength))
        accumulatedLength.insert(0, 0)
        accumulatedStation = [length + _stationStart for length in accumulatedLength]
    else:
        accumulatedStation = curvelength
#    return accumulatedStation

    for station in stations:
        for index, acs in enumerate(accumulatedStation):
            if accumulatedStation[index] <= station < accumulatedStation[index + 1]:
                group.append(index)
    return group
    
def ElevationAtStation(group, stations, curvetype, curvelength, pvielevation, slope):
    result = []
    accumulatedLength = list(accumulate(curvelength))
    accumulatedLength.insert(0, 0)
    accumulatedStation = [length + _stationStart for length in accumulatedLength]
    for g, st in zip(group, stations):
        # Station on Curve
        if curvetype[g] == "Curve":
            g1 = slope[g - 1] * 0.01
            g2 = slope[g + 1] * 0.01
            cl = curvelength[g]
            g1Elevation = pvielevation[g] - ((cl / 2) * g1)
            xDist = st - accumulatedStation[g]
            yDist = (g1Elevation + (g1 * xDist) + (((g2 - g1) * (xDist * xDist)) / (2 * cl)))
            result.append(yDist)
        # Station on Line
        elif curvetype[g] == "Line":
            if g == 0:
                g1 = slope[g] * 0.01
                g1Elevation = pvielevation[g + 1] - (g1 * (curvelength[g + 1] / 2))
                xDist = accumulatedStation[g + 1] - st
                yDist = g1Elevation - (g1 * xDist)
                result.append(yDist)
            # This Line is not last one.
            elif g < max(group):
                g1 = slope[g] * 0.01
                g1Elevation = pvielevation[g - 1] - (g1 * (curvelength[g - 1] / 2))
                xDist = accumulatedStation[g + 1] - st
                yDist = g1Elevation - (g1 * xDist)
                result.append(yDist)
            # This Line is the last one.
            else:
                g1 = slope[g] * 0.01
                g1Elevation = pvielevation[g - 1] + (g1 * (curvelength[g - 1] / 2))
                xDist = st - accumulatedStation[g]
                yDist = g1Elevation + (g1 * xDist)
                result.append(yDist)
    return result

def SuperElevationAtStation(stations, slopeatmark, stationatmark):
    slopes = []
    superElevationGroup = RangeTypeAtStation(stations, stationatmark, False)
    for station, seg in zip(stations, superElevationGroup):
        slopes.append(
            slopeatmark[seg] + (
                (slopeatmark[seg + 1] - slopeatmark[seg])
                / (stationatmark[seg + 1] - stationatmark[seg])
                * (station - stationatmark[seg])
            )
        )
    return slopes


for index, (sl, c_len) in enumerate(zip(slope, length)):
    if sl is not None:
        _CurveType.append("Line")
    else:
        _CurveType.append("Curve")

for index, (ct, cl) in enumerate(zip(_CurveType, length)):
    if index == 0:
        _CurveLength.append((pviStation[index + 1] - (length[index + 1] / 2)) - _stationStart)
    elif ct == "Curve":
	    _CurveLength.append(cl)
    elif ct == "Line":
	    if index == len(length) - 1:
	        _CurveLength.append(_stationEnd - (pviStation[index - 1] + (length[index - 1] / 2)))
	    else:
	        _CurveLength.append((pviStation[index + 1] - (length[index + 1] / 2)) - (pviStation[index - 1] + (length[index + 1] / 2)))

group = RangeTypeAtStation(target, _CurveLength)
ydisp = ElevationAtStation(group, target, _CurveType, _CurveLength, pviElevation, slope)
se = SuperElevationAtStation(target,superElevation , superElevationStation)

# Assign your output to the OUT variable.
OUT = ydisp, se
# ----------------------------------------

code_block_13 = CodeBlock(result=python_script) { result[0]; result[1]; }
watch = Watch(code_block_13.out0)
code_block_14 = CodeBlock(elev=watch) { elev*1000; }
watch_2 = Watch(code_block_13.out1)
flatten_2 = List.Flatten(list=code_block_12.out1)
code_block_15 = CodeBlock(placement=flatten, inner=flatten_2) { placement-inner; }
code_block_16 = CodeBlock(slope=watch_2, xdist=code_block_15) { (slope*xdist)/100; }
code_block_17 = CodeBlock(elev=code_block_14, ydisp=code_block_16) { elev+ydisp; }
code_block_18 = CodeBlock(placement=add, level=code_block_17) { Point.ByCoordinates(placement.X,placement.Y,level); }
byPoints = NurbsCurve.ByPoints(points=code_block_18)
parameterAtPoint = Curve.ParameterAtPoint(curve=byPoints, point=code_block_18)
tangentAtParameter = Curve.TangentAtParameter(curve=byPoints, param=parameterAtPoint)
cross = Vector.Cross(vector=tangentAtParameter, cross=code_block_7.out1)
python_script_2 = Python(IN[0]=cross, IN[1]=code_block_18, IN[2]=tangentAtParameter)  # frozen
# ---------- python_script_2.python (54 lines) ----------
import clr

clr.AddReference('RevitAPI')
from Autodesk.Revit.DB import *
from Autodesk.Revit.DB.Structure import *
from Autodesk.Revit.Creation import *

clr.AddReference('RevitAPIUI')
from Autodesk.Revit.UI import *

clr.AddReference('System')
from System.Collections.Generic import List

clr.AddReference('RevitNodes')
import Revit
clr.ImportExtensions(Revit.GeometryConversion)
clr.ImportExtensions(Revit.Elements)

clr.AddReference('RevitServices')
import RevitServices
from RevitServices.Persistence import DocumentManager
from RevitServices.Transactions import TransactionManager

doc = DocumentManager.Instance.CurrentDBDocument
uidoc=DocumentManager.Instance.CurrentUIApplication.ActiveUIDocument

# The inputs to this node will be stored as a list in the IN variables.
dataEnteringNode = IN
normalAtPoint = [nor.ToXyz() for nor in IN[0]]
points = [pt.ToXyz() for pt in IN[1]]
tangentAtPoint = [tan.ToXyz() for tan in IN[2]]
pts=[]
refpts = []
error = []

TransactionManager.Instance.EnsureInTransaction(doc)

for index, (normal, origin, tangent) in enumerate(zip(normalAtPoint, points, tangentAtPoint)):
	try:
		pln = Plane.CreateByNormalAndOrigin(normal, origin)
		skp = SketchPlane.Create(doc, pln).GetPlaneReference()
		pts.append(PointOnPlane.NewPointOnPlane(doc, skp, origin, tangent))
	except:
		error.append(index)
for pt in pts:
	refpts.append(doc.FamilyCreate.NewReferencePoint(pt))


TransactionManager.Instance.TransactionTaskDone()

# Place your code below this line

# Assign your output to the OUT variable.
OUT = refpts, error
# ----------------------------------------
byPoint = ReferencePoint.ByPoint(pt=code_block_18)
scale_2 = Vector.Scale(vector=code_block_7.out1, scale_factor=flatten_2)
add_2 = Point.Add(point=code_block_7.out0, vectorToAdd=scale_2)
code_block_19 = CodeBlock(placement=add_2, level=code_block_14) { Point.ByCoordinates(placement.X,placement.Y,level); }
byPoint_2 = ReferencePoint.ByPoint(pt=code_block_19)
isNull = Object.IsNull(obj=code_block_12.out2@L2)
flatten_3 = List.Flatten(list=isNull)
filterByBoolMask = List.FilterByBoolMask(list=code_block_7.out0, mask=flatten_3)
filterByBoolMask_2 = List.FilterByBoolMask(list=code_block_7.out1, mask=flatten_3)
boolean_2 = BoolSelector(false)
clean = List.Clean(list=code_block_12.out2, preserveIndices=boolean_2)
flatten_4 = List.Flatten(list=clean)
scale_3 = Vector.Scale(vector=filterByBoolMask_2.out, scale_factor=flatten_4)
add_3 = Point.Add(point=filterByBoolMask.out, vectorToAdd=scale_3)
filterByBoolMask_3 = List.FilterByBoolMask(list=code_block_14, mask=flatten_3)
filterByBoolMask_4 = List.FilterByBoolMask(list=watch_2, mask=flatten_3)
code_block_20 = CodeBlock(Outer=flatten_4, inner=flatten_2) { Outer-inner; }
code_block_21 = CodeBlock(slope=filterByBoolMask_4.out, xdist=code_block_20) { (slope*xdist)/100; }
code_block_22 = CodeBlock(elev=filterByBoolMask_3.out, ydisp=code_block_21) { elev+ydisp; }
code_block_23 = CodeBlock(placement=add_3, level=code_block_22) { Point.ByCoordinates(placement.X,placement.Y,level); }
byPoint_3 = ReferencePoint.ByPoint(pt=code_block_23)
list_create = List.Create(item0=code_block_18, item1=code_block_19, item2=code_block_23)
importExcel_4 = Data.ImportExcel(file=file_from_path, sheetName=code_block_6.out2)
restOfItems_5 = List.RestOfItems(list=importExcel_4)
transpose_4 = List.Transpose(lists=restOfItems_5)
code_block_24 = CodeBlock { "Optional Items"; }
firstItem_3 = List.FirstItem(list=importExcel_4)
code_block_25 = CodeBlock(data=importExcel_4) { List.AllIndicesOf(List.FirstItem(data),"SubPoint")+1; }
getItemAtIndex_3 = List.GetItemAtIndex(list=firstItem_3, index=code_block_25)
listview_data = Custom[Listview Data](InputName=code_block_24, Keys=getItemAtIndex_3, Values=code_block_25)  # package Data-Shapes; Create data for ListView input in UI.MultiInputForm ++ . Check out www.data-shapes.net for more infos.
multipleinputform_3 = Custom[MultipleInputForm ++](Inputs=listview_data, Toggle=multipleinputform_2.Was_Run)
flatten_5 = List.Flatten(list=multipleinputform_3.User_Inputs)
getItemAtIndex_4 = List.GetItemAtIndex(list=transpose_4, index=flatten_5)
scale_4 = Vector.Scale(vector=code_block_7.out1, scale_factor=getItemAtIndex_4@L2)
add_4 = Point.Add(point=code_block_7.out0, vectorToAdd=scale_4@L2)
code_block_26 = CodeBlock(opt=getItemAtIndex_4, inner=flatten_2) { opt-inner; }
code_block_27 = CodeBlock(slope=watch_2, xdist=code_block_26) { (slope*xdist@L2<2>)/100; }
code_block_28 = CodeBlock(elev=code_block_14, ydisp=code_block_27) { elev+ydisp@L2<2>; }
code_block_29 = CodeBlock(placement=add_4, level=code_block_28) { Point.ByCoordinates(placement.X,placement.Y,level); }
join_3 = List.Join(list0=list_create, list1=code_block_29)
code_block_30 = CodeBlock { "Select point to create reference line\ninner to outer direction"; }
code_block_31 = CodeBlock { "Start Point"; "End Point"; }
getItemAtIndex_5 = List.GetItemAtIndex(list=firstItem_2, index=multipleinputform_2.User_Inputs)
getItemAtIndex_6 = List.GetItemAtIndex(list=firstItem_3, index=flatten_5)
join_4 = List.Join(list0=getItemAtIndex_5, list1=getItemAtIndex_6)
code_block_32 = CodeBlock(list=join_4) { 0..List.Count(list); }
dropdown_data_4 = Custom[DropDown Data](InputName=code_block_31.out0, Keys=join_4, Values=code_block_32)
dropdown_data_5 = Custom[DropDown Data](InputName=code_block_31.out1, Keys=join_4, Values=code_block_32)
join_5 = List.Join(list0=dropdown_data_4, list1=dropdown_data_5)
multipleinputform_4 = Custom[MultipleInputForm ++](Description_optional=code_block_30, Inputs=join_5, Toggle=multipleinputform_3.Was_Run)
getItemAtIndex_7 = List.GetItemAtIndex(list=join_3, index=multipleinputform_4.User_Inputs)
firstItem_4 = List.FirstItem(list=getItemAtIndex_7)
lastItem = List.LastItem(list=getItemAtIndex_7)
byStartPointEndPoint = Line.ByStartPointEndPoint(startPoint=firstItem_4, endPoint=lastItem)
byCurve = ModelCurve.ByCurve(curve=byStartPointEndPoint)
code_block_33 = CodeBlock(dist=code_block_7.dist) { dist<50?true:false; }
code_block_34 = CodeBlock { true; }
allIndicesOf = List.AllIndicesOf(list=code_block_33, item=code_block_34)
removeItemAtIndex = List.RemoveItemAtIndex(list=byPoint, indices=allIndicesOf)
boolean_3 = BoolSelector(false)
byReferencePoints = CurveByPoints.ByReferencePoints(points=removeItemAtIndex, isReferenceLine=boolean_3)
list_create_2 = List.Create(item0=byReferencePoints)
code_block_35 = CodeBlock { 100; }
scale_5 = Vector.Scale(vector=tangentAtParameter, scale_factor=code_block_35)
code_block_36 = CodeBlock { 50; }
scale_6 = Vector.Scale(vector=cross, scale_factor=code_block_36)
byOriginVectors = Ellipse.ByOriginVectors(origin=code_block_18, xAxisRadius=scale_5, yAxisRadius=scale_6)
byCurve_2 = ModelCurve.ByCurve(curve=byOriginVectors)
code_block_37 = CodeBlock(lines=byStartPointEndPoint) { List.DropItems(List.Sublists(List.Flatten(lines),0..1,1),-1); }
byLoft = Surface.ByLoft(crossSections=code_block_37)
flatten_6 = List.Flatten(list=byLoft)
byGeometries = ImportInstance.ByGeometries(geometries=flatten_6)
list_create_3 = List.Create(item0=byGeometries)
list_create_4 = List.Create(item0=byPoint, item1=byPoint_2, item2=byPoint_3, item3=byCurve, item4=list_create_2, item5=byCurve_2, item6=list_create_3)
code_block_38 = CodeBlock { "Visible"; }
code_block_39 = CodeBlock(name=getItemAtIndex_5) { name; ["Reference Line","Placement Curve","Plane Normal Line", "Surfaces"]; }
join_6 = List.Join(list0=code_block_39.name, list1=code_block_39.out1)
code_block_40 = CodeBlock { "Family parameter"; "YesNo"; "PG_VISIBILITY"; true; }
python_script_3 = Python(IN[0]=join_6, IN[1]=code_block_40.out1, IN[2]=code_block_40.out2, IN[3]=code_block_40.out3)  # unwired: IN[4], IN[5], IN[6]
# ---------- python_script_3.python (50 lines) ----------
#Alban de Chasteigner 2020
#twitter : @geniusloci_bim
#geniusloci.bim@gmail.com

import clr
clr.AddReference('RevitAPI')
import Autodesk
from Autodesk.Revit.DB import *

clr.AddReference("RevitServices")
import RevitServices
from RevitServices.Persistence import DocumentManager
from RevitServices.Transactions import TransactionManager
doc = DocumentManager.Instance.CurrentDBDocument

paramName = IN[0]
parameterType = IN[1]
parameterGroup = IN[2]
instance = IN[3]
reporting = IN[4]
dimension = UnwrapElement(IN[5])
famParameter = UnwrapElement(IN[6])

TransactionManager.Instance.EnsureInTransaction(doc)
if famParameter == None:
	if isinstance(parameterGroup, basestring):
		exec("paramGroup = BuiltInParameterGroup.%s" % parameterGroup)
	else:
		paramGroup = parameterGroup
	
	if isinstance(parameterType, basestring):
		exec("paramType = ParameterType.%s" % parameterType)
	else :
		paramType = parameterType
	for name in paramName:
		try:
			familyParam = doc.FamilyManager.AddParameter(name, paramGroup, paramType, instance)
		except:
			True
	if reporting == True:
		doc.FamilyManager.MakeReporting(familyParam)
else:
	familyParam = famParameter

if dimension :
	dimension.FamilyLabel = familyParam
else:
	pass
TransactionManager.Instance.TransactionTaskDone()	
OUT = familyParam.Definition.Name
# ----------------------------------------
passthrough = Custom[Passthrough](passThrough=code_block_38, waitFor=python_script_3)  # package Clockwork for Dynamo 2.x; Forces a sequential order of execution. The node wired into the output of the Passthrough node will be executed *after* the node wired into the waitFor input (e.g. important for some Revit operations). The value of the passThrough input will be passed on to the node wired into the output port of the Passthrough node.
python_script_4 = Python(IN[0]=list_create_4, IN[1]=passthrough, IN[2]=join_6)
# ---------- python_script_4.python (66 lines) ----------
import clr
clr.AddReference('RevitAPI')
from Autodesk.Revit.DB import *

clr.AddReference('RevitNodes')

import Revit
clr.ImportExtensions(Revit.GeometryConversion)
clr.ImportExtensions(Revit.Elements)

clr.AddReference('RevitServices')
from RevitServices.Persistence import DocumentManager
from RevitServices.Transactions import TransactionManager

doc = DocumentManager.Instance.CurrentDBDocument


elements_set = IN[0]
epSearch = IN[1]
fpSearch_set = IN[2]

	
for elements, fpSearch in zip(elements_set, fpSearch_set):
	if not isinstance(elements, list):
		elements = [elements]
	if not isinstance(epSearch, list):
		epSearch = [epSearch]
	if not isinstance(fpSearch, list):
		fpSearch = [fpSearch]
	for e in elements:
		e = UnwrapElement(e)
		elemParams = e.Parameters
	
		epNames = []
		fpNames = []
		elemAssoc = []
		famAssoc = []
		
		for ep in elemParams:
			epNames.append(ep.Definition.Name)
			
		epDict = dict(zip(epNames,elemParams))
		elemAssoc = [epDict.get(ep, "none") for ep in epSearch]
		
		famParams = doc.FamilyManager.Parameters
		
		for fp in famParams:
			fpNames.append(fp.Definition.Name)
			
		fpDict = dict(zip(fpNames,famParams))
		famAssoc = [fpDict.get(fp,"none") for fp in fpSearch]
		
	
		TransactionManager.Instance.EnsureInTransaction(doc)
		
		for i,j in zip(elemAssoc,famAssoc):
			try:
				doc.FamilyManager.AssociateElementParameterToFamilyParameter(i, j)
				error_report = "No errors"
				
			except:
				error_report = "can't assign parameter"
		TransactionManager.Instance.TransactionTaskDone()


OUT = elements,error_report
# ----------------------------------------
