# Dynamo graph Horizontal Alignment_Segment_Main_AlignmentAndOffset.dyn "Horizontal Alignment_SubAlignment" (Dynamo 2.3.1.11775)
# packages: bimorphNodes 3.0.3

reverse_alignment = BoolSelector(true)
select_alignment = DSModelElementSelection()  # 1 picked in the model
string = StringInput("C-_RSUPMALG_E-")
curvesFromCADLayers = CAD.CurvesFromCADLayers(importInstance=select_alignment, layerNames=string)
flatten = List.Flatten(list=curvesFromCADLayers.Curve)
byJoinedCurves = PolyCurve.ByJoinedCurves(curves=flatten)
code_block = CodeBlock(isReversed=reverse_alignment, alignment=byJoinedCurves) { isReversed?Autodesk.Curve.Reverse(alignment):alignment; }
startPoint = Curve.StartPoint(curve=code_block)
code_block_2 = CodeBlock { 1000; Vector.ByCoordinates(0,0,1); }
byCenterPointRadiusNormal = Circle.ByCenterPointRadiusNormal(centerPoint=startPoint, radius=code_block_2.out0, normal=code_block_2.out1)
code_block_3 = CodeBlock { 3; }
regularPolygon = Polygon.RegularPolygon(circle=byCenterPointRadiusNormal, numberSides=code_block_3)
empty = List.Empty()
export = BoolSelector(false)
file_path = Filename(".\Family.xlsx")
code_block_4 = CodeBlock(go=export, path=file_path) { go?path:""; }
code_block_5 = CodeBlock { "Alignment"; }
code_block_6 = CodeBlock { 0; }
string_2 = StringInput("HorizontalCurve")
code_block_7 = CodeBlock(name=string_2) { name; "Point.X"; "Point.Y"; "Vector.X"; "Vector.Y"; "Station"; "Distance to next"; }
list_create = List.Create(item0=code_block_7.name, item1=code_block_7.out1, item2=code_block_7.out2, item3=code_block_7.out3, item4=code_block_7.out4, item5=code_block_7.out5, item6=code_block_7.out6)
vector_reverse = BoolSelector(true)
select_sub_alignment = DSModelElementSelection()  # 1 picked in the model
string_3 = StringInput("PlacementCurve_NB")
curvesFromCADLayers_2 = CAD.CurvesFromCADLayers(importInstance=select_sub_alignment, layerNames=string_3)
flatten_2 = List.Flatten(list=curvesFromCADLayers_2.Curve)
byJoinedCurves_2 = PolyCurve.ByJoinedCurves(curves=flatten_2)
watch = Watch(byJoinedCurves_2)
select_segment_lines = DSModelElementSelection()  # 1 picked in the model
string_4 = StringInput("S-_SEG-----_E-NB")
curvesFromCADLayers_3 = CAD.CurvesFromCADLayers(importInstance=select_segment_lines, layerNames=string_4)
flatten_3 = List.Flatten(list=curvesFromCADLayers_3.Curve)
type = Object.Type(obj=flatten_3)
string_5 = StringInput("Arc")
contains = String.Contains(str=type, searchFor=string_5)
filterByBoolMask = List.FilterByBoolMask(list=flatten_3, mask=contains)
removeDuplicates = Curve.RemoveDuplicates(curves=filterByBoolMask.out)
code_block_8 = CodeBlock(cleaned=removeDuplicates.cleanedCurves, ref=flatten_2) { List.Flatten([cleaned, ref]); }
intersectAll = Curve.IntersectAll(curves=code_block_8)
intersectAll_2 = Curve.IntersectAll(curves=flatten_2)
setDifference = List.SetDifference(list1=intersectAll, list2=intersectAll_2)
parameterAtPoint = Curve.ParameterAtPoint(curve=watch, point=setDifference)
sortByKey = List.SortByKey(list=setDifference, keys=parameterAtPoint)
tangentAtParameter = Curve.TangentAtParameter(curve=watch, param=sortByKey.sorted_keys)
normalAtParameter = Curve.NormalAtParameter(curve=watch, param=sortByKey.sorted_keys)
code_block_9 = CodeBlock(tan=tangentAtParameter, nor=normalAtParameter) { Vector.Cross(tan,nor).Z==1?nor:Vector.Reverse(nor); }
code_block_10 = CodeBlock(isReversed=vector_reverse, dir=code_block_9) { isReversed?Vector.Reverse(dir):dir; }
watch_2 = Watch(code_block_10)
count = List.Count(list=watch_2)
code_block_11 = CodeBlock(end=count) { 0..end-1; }
code_block_12 = CodeBlock { 15000; }
byStartPointDirectionLength = Line.ByStartPointDirectionLength(startPoint=sortByKey.sorted_list, direction=code_block_10, length=code_block_12)
code_block_13 = CodeBlock(alignment=flatten, lines=byStartPointDirectionLength) { List.Flatten([alignment,lines]); }
intersectAll_3 = Curve.IntersectAll(curves=code_block_13)
intersectAll_4 = Curve.IntersectAll(curves=flatten)
setDifference_2 = List.SetDifference(list1=intersectAll_3, list2=intersectAll_4)
parameterAtPoint_2 = Curve.ParameterAtPoint(curve=code_block, point=setDifference_2)
sortByKey_2 = List.SortByKey(list=setDifference_2, keys=parameterAtPoint_2)
watch_3 = Watch(sortByKey_2.sorted_list)
code_block_14 = CodeBlock(pt=watch_3) { pt.X; pt.Y; }
reverse = Vector.Reverse(vector=watch_2)
code_block_15 = CodeBlock(pt=reverse) { pt.X; pt.Y; }
segmentLengthAtParameter = Curve.SegmentLengthAtParameter(curve=code_block, param=sortByKey_2.sorted_keys)
restOfItems = List.RestOfItems(list=segmentLengthAtParameter)
sub = restOfItems - segmentLengthAtParameter
list_create_2 = List.Create(item0=code_block_11, item1=code_block_14.out0, item2=code_block_14.out1, item3=code_block_15.out0, item4=code_block_15.out1, item5=segmentLengthAtParameter, item6=sub)
transpose = List.Transpose(lists=list_create_2)
addItemToFront = List.AddItemToFront(item=list_create, list=transpose)
code_block_16 = CodeBlock(go=export, path=addItemToFront) { go?path:""; }
exportExcel = Data.ExportExcel(filePath=code_block_4, sheetName=code_block_5, startRow=code_block_6, startCol=code_block_6, data=code_block_16)
startPoint_2 = Curve.StartPoint(curve=byJoinedCurves_2)
code_block_17 = CodeBlock { 1000; Vector.ByCoordinates(0,0,1); }
byCenterPointRadiusNormal_2 = Circle.ByCenterPointRadiusNormal(centerPoint=startPoint_2, radius=code_block_17.out0, normal=code_block_17.out1)
code_block_18 = CodeBlock { 3; }
regularPolygon_2 = Polygon.RegularPolygon(circle=byCenterPointRadiusNormal_2, numberSides=code_block_18)
count_2 = List.Count(list=list_create_2@L2)
code_block_19 = CodeBlock(a=count_2) { List.AllTrue(a[0]==a[1..5])?"Pass":"Data Index is not equal"; }
watch_4 = Watch(code_block_19)
