# Dynamo graph AlignmentOnEdge.dyn (Dynamo 2.3.1.11775)
# packages: bimorphNodes 3.0.3, Clockwork for Dynamo 2.x 2.3.0

select_model_element = DSModelElementSelection()  # 1 picked in the model
code_block = CodeBlock { "OuterEdge"; "InnerEdge"; }
curvesFromCADLayers = CAD.CurvesFromCADLayers(importInstance=select_model_element, layerNames=code_block.out0)
byJoinedCurves = PolyCurve.ByJoinedCurves(curves=curvesFromCADLayers.Curve)
curvesFromCADLayers_2 = CAD.CurvesFromCADLayers(importInstance=select_model_element, layerNames=code_block.out1)
byJoinedCurves_2 = PolyCurve.ByJoinedCurves(curves=curvesFromCADLayers_2.Curve)
code_block_2 = CodeBlock { end?crv.Length:target_end; }  # unwired: end, crv, target_end
select_model_element_2 = DSModelElementSelection()  # 1 picked in the model
code_block_3 = CodeBlock { "C-_NBTUN---_E-"; }
curvesFromCADLayers_3 = CAD.CurvesFromCADLayers(importInstance=select_model_element_2, layerNames=code_block_3)
byJoinedCurves_3 = PolyCurve.ByJoinedCurves(curves=curvesFromCADLayers_3.Curve)
startPoint = Curve.StartPoint(curve=byJoinedCurves_3)
code_block_4 = CodeBlock { 12600; }
code_block_5 = CodeBlock { 11310; }
code_block_6 = CodeBlock(target_start=code_block_4, start=code_block_5) { (target_start-start)*1000; }
reverse = Curve.Reverse(curve=byJoinedCurves_3)
code_block_7 = CodeBlock(curve=reverse) { curve; }
code_block_8 = CodeBlock { 1; }
segmentLengthAtParameter = Curve.SegmentLengthAtParameter(curve=code_block_7, param=code_block_8)
code_block_9 = CodeBlock { 1000; }
code_block_10 = CodeBlock(start=code_block_6, end=segmentLengthAtParameter, interval=code_block_9) { start..end..#((end-start)/interval); }
code_block_11 = CodeBlock(tartget=code_block_10, start=code_block_5) { tartget+(start*1000); }
file_path = Filename("Z:\OneDrive - TAESUNG SNI (Paid)\01_Working Model\04_TRF\02_Sub Item\00_Alignment\00_Data\NSC_NB_Alignment_ALT1.xlsx")
code_block_12 = CodeBlock { "General"; }
code_block_13 = CodeBlock { 0; }
code_block_14 = CodeBlock { ["SubPoint","InnerEdge","SubPoint","OuterEdge"]; }
flatten = List.Flatten(list=code_block_10)
file_from_path = FileObject(path=file_path)
code_block_15 = CodeBlock { "Vertical Curve"; }
importExcel = Data.ImportExcel(file=file_from_path, sheetName=code_block_15)
restOfItems = List.RestOfItems(list=importExcel)
transpose = List.Transpose(lists=restOfItems)
code_block_16 = CodeBlock(station=transpose) { station[4][1..(List.Count(station)-1)]; }
watch = Watch(code_block_16)
code_block_17 = CodeBlock(station=watch, start=code_block_5) { (station-start)*1000; }
replace_to_new_station = Python(IN[0]=flatten, IN[1]=code_block_17)
# ---------- replace_to_new_station.python (26 lines) ----------
# Load the Python Standard and DesignScript Libraries
import sys
import clr
clr.AddReference('ProtoGeometry')
from Autodesk.DesignScript.Geometry import *

# The inputs to this node will be stored as a list in the IN variables.
dataEnteringNode = IN
original = IN[0]
add = IN[1]
interval = (original[1] - original[0])*1.5
# Place your code below this line
for a in add:
	candidate=[]
	candidate_index=[]
	for index, o in enumerate(original):
		if original[0] > a:
			break
		elif abs(o - a) < interval:
			candidate.append(abs(o-a))
			candidate_index.append(index)
	for index, c in zip(candidate_index, candidate):
		if min(candidate) == c:
			original[index] = a
# Assign your output to the OUT variable.
OUT = original
# ----------------------------------------
parameterAtSegmentLength = Curve.ParameterAtSegmentLength(curve=code_block_7@L1, segmentLength=replace_to_new_station)
flatten_2 = List.Flatten(list=parameterAtSegmentLength)
code_block_18 = CodeBlock(lst=flatten_2)
# ---------- code_block_18.designscript (3 lines) ----------
List.LastItem(lst)==1?
List.ReplaceItemAtIndex(lst,List.Count(lst)-1,1):
lst;
# ----------------------------------------
pointAtParameter = Curve.PointAtParameter(curve=code_block_7@L1, param=code_block_18)
flatten_3 = List.Flatten(list=pointAtParameter)
tangentAtParameter = Curve.TangentAtParameter(curve=code_block_7@L1, param=code_block_18)
normalAtParameter = Curve.NormalAtParameter(curve=code_block_7@L1, param=code_block_18)
code_block_19 = CodeBlock(tan=tangentAtParameter, nor=normalAtParameter) { Vector.Cross(tan,nor).Z==1?nor:Vector.Reverse(nor); }
code_block_20 = CodeBlock { 30000; }
byStartPointDirectionLength = Line.ByStartPointDirectionLength(startPoint=flatten_3, direction=code_block_19@L2, length=code_block_20)
extendStart = Curve.ExtendStart(curve=byStartPointDirectionLength, distance=code_block_20)
code_block_21 = CodeBlock(inner=curvesFromCADLayers_2.Curve) { inner; }
addItemToEnd = List.AddItemToEnd(item=extendStart@L1, list=code_block_21)
flatten_4 = List.Flatten(list=addItemToEnd@L3)
intersectAll = Curve.IntersectAll(curves=flatten_4)
intersectAll_2 = Curve.IntersectAll(curves=code_block_21)
flatten_5 = List.Flatten(list=intersectAll_2)
setDifference = List.SetDifference(list1=intersectAll@L2, list2=flatten_5)
python_script = Python(IN[0]=setDifference)
# ---------- python_script.python (9 lines) ----------
list = IN[0]
set = []
for i in list:
	if len(i) == 1:
		set.append(i[0])
	else:
		set.append(None)

OUT = set
# ----------------------------------------
byStartPointDirectionLength_2 = Line.ByStartPointDirectionLength(startPoint=flatten_3, direction=code_block_19@L2, length=code_block_20)
code_block_22 = CodeBlock(outer=curvesFromCADLayers.Curve) { outer; }
addItemToEnd_2 = List.AddItemToEnd(item=byStartPointDirectionLength_2@L1, list=code_block_22)
flatten_6 = List.Flatten(list=addItemToEnd_2@L3)
intersectAll_3 = Curve.IntersectAll(curves=flatten_6)
intersectAll_4 = Curve.IntersectAll(curves=code_block_22)
flatten_7 = List.Flatten(list=intersectAll_4)
setDifference_2 = List.SetDifference(list1=intersectAll_3@L2, list2=flatten_7)
python_script_2 = Python(IN[0]=setDifference_2)  # same code as python_script
byStartPointEndPoint = Line.ByStartPointEndPoint(startPoint=python_script, endPoint=python_script_2)
isNull = Object.IsNull(obj=byStartPointEndPoint)
boolean = BoolSelector(true)
allIndicesOf = List.AllIndicesOf(list=isNull, item=boolean)
removeItemAtIndex = List.RemoveItemAtIndex(list=byStartPointEndPoint, indices=allIndicesOf)
direction = Line.Direction(line=removeItemAtIndex)
normalized = Vector.Normalized(vector=direction)
byTwoPoints = Vector.ByTwoPoints(start=flatten_3, end=python_script)
removeItemAtIndex_2 = List.RemoveItemAtIndex(list=byTwoPoints, indices=allIndicesOf)
normalized_2 = Vector.Normalized(vector=removeItemAtIndex_2)
add = Vector.Add(vector=normalized, vectorToAdd=normalized_2)
length = Vector.Length(vector=add)
distanceTo = Geometry.DistanceTo(geometry=flatten_3, other=python_script)
removeItemAtIndex_3 = List.RemoveItemAtIndex(list=distanceTo, indices=allIndicesOf)
code_block_23 = CodeBlock(len=length, dist=removeItemAtIndex_3) { len>1?-dist:dist; }
code_block_24 = CodeBlock(val=code_block_23) { 0..List.Count(val)-1; }
distanceTo_2 = Geometry.DistanceTo(geometry=flatten_3, other=python_script_2)
removeItemAtIndex_4 = List.RemoveItemAtIndex(list=distanceTo_2, indices=allIndicesOf)
list_create = List.Create(item0=code_block_24, item1=code_block_23, item2=code_block_24, item3=removeItemAtIndex_4)
transpose_2 = List.Transpose(lists=list_create)
addItemToFront = List.AddItemToFront(item=code_block_14, list=transpose_2)
code_block_25 = CodeBlock { "Alignment"; }
code_block_26 = CodeBlock { ["HorizontalCurve","Point.X","Point.Y","Vector.X","Vector.Y","Station","Distance to Next"]; }
removeItemAtIndex_5 = List.RemoveItemAtIndex(list=flatten_3, indices=allIndicesOf)
code_block_27 = CodeBlock(alignment_pt=removeItemAtIndex_5) { alignment_pt; }
removeItemAtIndex_6 = List.RemoveItemAtIndex(list=replace_to_new_station, indices=allIndicesOf)
restOfItems_2 = List.RestOfItems(list=replace_to_new_station)
code_block_28 = CodeBlock(a=restOfItems_2, b=replace_to_new_station) { a-b; }
removeItemAtIndex_7 = List.RemoveItemAtIndex(list=code_block_28, indices=allIndicesOf)
code_block_29 = CodeBlock(pts=code_block_27, vecs=normalized, station=removeItemAtIndex_6, dist=removeItemAtIndex_7) { pts.X; pts.Y; vecs.X; vecs.Y; station; dist; }
code_block_30 = CodeBlock(val=code_block_29.out0) { 0..List.Count(val)-1; }
list_create_2 = List.Create(item0=code_block_30, item1=code_block_29.out0, item2=code_block_29.out1, item3=code_block_29.out2, item4=code_block_29.out3, item5=code_block_29.station, item6=code_block_29.dist)
transpose_3 = List.Transpose(lists=list_create_2)
addItemToFront_2 = List.AddItemToFront(item=code_block_26, list=transpose_3)
exportExcel = Data.ExportExcel(filePath=file_path, sheetName=code_block_25, startRow=code_block_13, startCol=code_block_13, data=addItemToFront_2)
passthrough = Custom[Passthrough](passThrough=addItemToFront, waitFor=exportExcel)  # package Clockwork for Dynamo 2.x; Forces a sequential order of execution. The node wired into the output of the Passthrough node will be executed *after* the node wired into the waitFor input (e.g. important for some Revit operations). The value of the passThrough input will be passed on to the node wired into the output port of the Passthrough node.
exportExcel_2 = Data.ExportExcel(filePath=file_path, sheetName=code_block_12, startRow=code_block_13, startCol=code_block_13, data=passthrough)
passthrough_2 = Custom[Passthrough](passThrough=file_path, waitFor=exportExcel_2)
code_block_31 = CodeBlock { "Optional"; }
code_block_32 = CodeBlock { ""; }
exportExcel_3 = Data.ExportExcel(filePath=passthrough_2, sheetName=code_block_31, startRow=code_block_13, startCol=code_block_13, data=code_block_32)
