# Dynamo graph CurveLibraryTest.dyn (Dynamo 2.3.2.15696)
# packages: spring nodes 204.1.0

join = List.Join()  # unwired: list0, list1
list_create = List.Create()  # unwired: item0, item1
select_model_elements = DSModelElementsSelection()  # 7 picked in the model
code_block = CodeBlock(a=select_model_elements) { List.Flatten(a.Curves); }
type = Object.Type(obj=code_block)
code_block_2 = CodeBlock(str=type) { String.Contains(str,"Line")?2:3; }
code_block_3 = CodeBlock(num=code_block_2) { 0..1..#num; 0..1..#3; }
pointAtParameter = Curve.PointAtParameter(curve=code_block, param=code_block_3.out0)
code_block_4 = CodeBlock(a=pointAtParameter) { a.X; a.Y; }
combine = List.Combine(comb=list_create, list1=code_block_4.out0, list2=code_block_4.out1)
transpose = List.Transpose(lists=combine@L3)
list_create_2 = List.Create()  # unwired: item0, item1
select_model_elements_2 = DSModelElementsSelection()  # 2 picked in the model
code_block_5 = CodeBlock(a=select_model_elements_2) { List.Flatten(a.Curves); }
code_block_6 = CodeBlock { 0..1..#2; }
pointAtParameter_2 = Curve.PointAtParameter(curve=code_block_5@L1, param=code_block_6)
code_block_7 = CodeBlock(a=pointAtParameter_2) { a.X; a.Y; }
combine_2 = List.Combine(comb=list_create_2, list1=code_block_7.out0, list2=code_block_7.out1)
transpose_2 = List.Transpose(lists=combine_2@L3)
python_script = Python(IN[0]=transpose, IN[1]=transpose_2)
# ---------- python_script.python (42 lines) ----------
# Load the Python Standard and DesignScript Libraries
import sys
import clr
clr.AddReference('ProtoGeometry')
from Autodesk.DesignScript.Geometry import *
sys.path.append('C:\Users\dlagu\OneDrive\Documents\GitHub\DY-Dynamo\script\Python\Align.extension\lib')
import CurveProcessor as CP

# The inputs to this node will be stored as a list in the IN variables.
dataEnteringNode = IN
intersect = CP.Intersect()
data = IN[0]
length = IN[1]
translated = []
lines = []
for i in IN[0]:
	if len(i) == 2:
		pt1 = CP.PointEntity(i[0][0], i[0][1])
		pt2 = CP.PointEntity(i[1][0], i[1][1])
		translated.append(CP.LineEntity(pt1, pt2))
	else:
		create = CP.CreateEntity()
		pt1 = CP.PointEntity(i[0][0], i[0][1])
		pt2 = CP.PointEntity(i[1][0], i[1][1])
		pt3 = CP.PointEntity(i[2][0], i[2][1])
		translated.append(create.ArcByThreePoints(pt1, pt3, pt2))
for i in IN[1]:
	pt1 = CP.PointEntity(i[0][0], i[0][1])
	pt2 = CP.PointEntity(i[1][0], i[1][1])
	lines.append(CP.LineEntity(pt1, pt2))
poly = CP.PolyCurveEntity(translated)
pt = []
for line in lines:
	pt.append(poly.IntersectWith(line))

aa = poly.SegmentLengthAtPoint(CP.Flatten(pt)[0])
bb = translated[1].IsInside(CP.Flatten(pt)[0])
# Place your code below this line
try:
	OUT = [p() for p in CP.Flatten(pt)], aa, bb, CP.Flatten(pt)[0]()
except:
	OUT = pt
# ----------------------------------------
code_block_8 = CodeBlock(a=python_script) { a; }
ꟿ_list_firstlast = Custom[ꟿ List.FirstLast](list=code_block_8@L2)  # package spring nodes; Simple utility node to get both the first and last items of a list as separate outputs. This avoids the unnecessary sublist when using the List.Deconstruct node.
byCoordinates = Point.ByCoordinates(x=ꟿ_list_firstlast.first, y=ꟿ_list_firstlast.last)
number_slider = DoubleSlider(0, range=0..5 step 1)
code_block_9 = CodeBlock(a=byCoordinates, x=number_slider) { a[x]; }
code_block_10 = CodeBlock(a=code_block, x=number_slider) { a[x].StartPoint; }
byJoinedCurves = PolyCurve.ByJoinedCurves(curves=code_block)
length = Curve.Length(curve=byJoinedCurves)
number_slider_2 = DoubleSlider(31324, range=0..70000 step 1)
code_block_11 = CodeBlock(a=python_script) { a[2]; }
ꟿ_list_firstlast_2 = Custom[ꟿ List.FirstLast](list=code_block_11@L2)
byCoordinates_2 = Vector.ByCoordinates(x=ꟿ_list_firstlast_2.first, y=ꟿ_list_firstlast_2.last)
code_block_12 = CodeBlock(pt=byCoordinates, dir=byCoordinates_2) { Line.ByStartPointDirectionLength(pt, dir, 1000); }
list_create_3 = List.Create()  # unwired: item0, item1
select_model_element = DSModelElementSelection()  # 1 picked in the model
code_block_13 = CodeBlock(a=select_model_element) { a.Curves; }
code_block_14 = CodeBlock(num=code_block_2) { 0..1..#num; 0..1..#3; }
pointAtParameter_3 = Curve.PointAtParameter(curve=code_block_13, param=code_block_14.out1@L1)
flatten = List.Flatten(list=pointAtParameter_3)
code_block_15 = CodeBlock(a=flatten) { a.X; a.Y; }
combine_3 = List.Combine(comb=list_create_3, list1=code_block_15.out0, list2=code_block_15.out1)
list_create_4 = List.Create()  # unwired: item0, item1
select_model_element_2 = DSModelElementSelection()  # 1 picked in the model
code_block_16 = CodeBlock(a=select_model_element_2) { a.Curves; }
code_block_17 = CodeBlock { [0,1]; }
pointAtParameter_4 = Curve.PointAtParameter(curve=code_block_16, param=code_block_17@L1)
flatten_2 = List.Flatten(list=pointAtParameter_4)
code_block_18 = CodeBlock(a=flatten_2) { a.X; a.Y; }
combine_4 = List.Combine(comb=list_create_4, list1=code_block_18.out0, list2=code_block_18.out1)
python_script_2 = Python(IN[0]=combine_3, IN[1]=combine_4)
# ---------- python_script_2.python (28 lines) ----------
# Load the Python Standard and DesignScript Libraries
import sys
import clr
clr.AddReference('ProtoGeometry')
from Autodesk.DesignScript.Geometry import *
sys.path.append('C:\Users\dlagu\OneDrive\Documents\GitHub\DY-Dynamo\script\Python\Align.extension\lib')
import CurveProcessor as CP
import math

# The inputs to this node will be stored as a list in the IN variables.
dataEnteringNode = IN
create = CP.CreateEntity()
arc_pts = [CP.PointEntity(a[0],a[1]) for a in IN[0]]
arc = create.ArcByThreePoints(arc_pts[0], arc_pts[2], arc_pts[1])
line_pts = [CP.PointEntity(a[0],a[1]) for a in IN[1]]
line = CP.LineEntity(line_pts[0], line_pts[1])
# Place your code below this line
inter = CP.Intersect()
a = inter.ByArcAndLine(arc, line, False)
aa = arc.IsInside(a[0])
OUT = aa
"""
# Assign your output to the OUT variable.
try:
	OUT = [aa() for aa in a]
except:
	OUT = a
"""
# ----------------------------------------
watch = Watch(python_script_2)
ꟿ_list_firstlast_3 = Custom[ꟿ List.FirstLast](list=watch@L2)
byCoordinates_3 = Point.ByCoordinates(x=ꟿ_list_firstlast_3.first, y=ꟿ_list_firstlast_3.last)
ꟿ_list_firstlast_4 = Custom[ꟿ List.FirstLast](list=code_block_8)
byCoordinates_4 = Point.ByCoordinates(x=ꟿ_list_firstlast_4.first, y=ꟿ_list_firstlast_4.last)
code_block_19 = CodeBlock(a=code_block_5) { a[0]; }
code_block_20 = CodeBlock { -4471.99202; }
byCoordinates_5 = Point.ByCoordinates(y=code_block_20)
code_block_21 = CodeBlock(a=python_script) { a[1][1]; }
ꟿ_points_pruneduplicates = Custom[ꟿ Points.PruneDuplicates+]()  # package spring nodes; An alternative to the built in node, that performs faster at the price of loosing the order of the points. All floating point valies are rounded to the nearest 4 decimal points. You can optionally remove duplicate Z values by setting "keepDuplicateZ" to false.; unwired: points
