# Dynamo graph Horizontal Alignment_MainAlignmentOnly.dyn (Dynamo 2.3.1.11775)
# packages: bimorphNodes 3.0.3

select_segment_lines = DSModelElementSelection()  # 1 picked in the model
string = StringInput("S-_SEG-----_E-")
curvesFromCADLayers = CAD.CurvesFromCADLayers(importInstance=select_segment_lines, layerNames=string)
flatten = List.Flatten(list=curvesFromCADLayers.Curve)
type = Object.Type(obj=flatten)
string_2 = StringInput("Arc")
contains = String.Contains(str=type, searchFor=string_2)
filterByBoolMask = List.FilterByBoolMask(list=flatten, mask=contains)
removeDuplicates = Curve.RemoveDuplicates(curves=filterByBoolMask.out)
select_sub_alignment = DSModelElementSelection()  # 1 picked in the model
string_3 = StringInput("PlacementCurve_NB")
curvesFromCADLayers_2 = CAD.CurvesFromCADLayers(importInstance=select_sub_alignment, layerNames=string_3)
flatten_2 = List.Flatten(list=curvesFromCADLayers_2.Curve)
code_block = CodeBlock(cleaned=removeDuplicates.cleanedCurves, ref=flatten_2) { List.Flatten([cleaned, ref]); }
intersectAll = Curve.IntersectAll(curves=code_block)
intersectAll_2 = Curve.IntersectAll(curves=flatten_2)
setDifference = List.SetDifference(list1=intersectAll, list2=intersectAll_2)
byJoinedCurves = PolyCurve.ByJoinedCurves(curves=flatten_2)
watch = Watch(byJoinedCurves)
parameterAtPoint = Curve.ParameterAtPoint(curve=watch, point=setDifference)
sortByKey = List.SortByKey(list=setDifference, keys=parameterAtPoint)
vector_reverse = BoolSelector(true)
tangentAtParameter = Curve.TangentAtParameter(curve=watch, param=sortByKey.sorted_keys)
normalAtParameter = Curve.NormalAtParameter(curve=watch, param=sortByKey.sorted_keys)
code_block_2 = CodeBlock(tan=tangentAtParameter, nor=normalAtParameter) { Vector.Cross(tan,nor).Z==1?nor:Vector.Reverse(nor); }
code_block_3 = CodeBlock(isReversed=vector_reverse, dir=code_block_2) { isReversed?Vector.Reverse(dir):dir; }
code_block_4 = CodeBlock { 15000; }
byStartPointDirectionLength = Line.ByStartPointDirectionLength(startPoint=sortByKey.sorted_list, direction=code_block_3, length=code_block_4)
empty = List.Empty()
export = BoolSelector(false)
file_path = Filename(".\Mainalignment.xlsx")
code_block_5 = CodeBlock(go=export, path=file_path) { go?path:""; }
code_block_6 = CodeBlock { "Alignment"; }
code_block_7 = CodeBlock { 0; }
string_4 = StringInput("HorizontalCurve")
code_block_8 = CodeBlock(name=string_4) { name; "Point.X"; "Point.Y"; "Vector.X"; "Vector.Y"; "Station"; "Distance to next"; }
list_create = List.Create(item0=code_block_8.name, item1=code_block_8.out1, item2=code_block_8.out2, item3=code_block_8.out3, item4=code_block_8.out4, item5=code_block_8.out5, item6=code_block_8.out6)
watch_2 = Watch(code_block_3)
count = List.Count(list=watch_2)
code_block_9 = CodeBlock(end=count) { 0..end-1; }
watch_3 = Watch(sortByKey.sorted_list)
code_block_10 = CodeBlock(pt=watch_3) { pt.X; pt.Y; }
reverse = Vector.Reverse(vector=watch_2)
code_block_11 = CodeBlock(pt=reverse) { pt.X; pt.Y; }
segmentLengthAtParameter = Curve.SegmentLengthAtParameter(curve=watch, param=sortByKey.sorted_keys)
restOfItems = List.RestOfItems(list=segmentLengthAtParameter)
sub = restOfItems - segmentLengthAtParameter
list_create_2 = List.Create(item0=code_block_9, item1=code_block_10.out0, item2=code_block_10.out1, item3=code_block_11.out0, item4=code_block_11.out1, item5=segmentLengthAtParameter, item6=sub)
transpose = List.Transpose(lists=list_create_2)
addItemToFront = List.AddItemToFront(item=list_create, list=transpose)
code_block_12 = CodeBlock(go=export, path=addItemToFront) { go?path:""; }
exportExcel = Data.ExportExcel(filePath=code_block_5, sheetName=code_block_6, startRow=code_block_7, startCol=code_block_7, data=code_block_12)
startPoint = Curve.StartPoint(curve=byJoinedCurves)
code_block_13 = CodeBlock { 1000; Vector.ByCoordinates(0,0,1); }
byCenterPointRadiusNormal = Circle.ByCenterPointRadiusNormal(centerPoint=startPoint, radius=code_block_13.out0, normal=code_block_13.out1)
code_block_14 = CodeBlock { 3; }
regularPolygon = Polygon.RegularPolygon(circle=byCenterPointRadiusNormal, numberSides=code_block_14)
