# Dynamo graph Horizontal Alignment_Segment_Sub_EdgePoints.dyn (Dynamo 2.3.1.11775)
# packages: bimorphNodes 3.0.3

file_path = Filename(".\Family.xlsx")
file_from_path = FileObject(path=file_path)
string = StringInput("Alignment")
importExcel = Data.ImportExcel(file=file_from_path, sheetName=string)
restOfItems = List.RestOfItems(list=importExcel)
transpose = List.Transpose(lists=restOfItems)
code_block = CodeBlock { 1; 2; 3; 4; }
getItemAtIndex = List.GetItemAtIndex(list=transpose, index=code_block.out0)
getItemAtIndex_2 = List.GetItemAtIndex(list=transpose, index=code_block.out1)
byCoordinates = Point.ByCoordinates(x=getItemAtIndex, y=getItemAtIndex_2)
getItemAtIndex_3 = List.GetItemAtIndex(list=transpose, index=code_block.out2)
getItemAtIndex_4 = List.GetItemAtIndex(list=transpose, index=code_block.out3)
byCoordinates_2 = Vector.ByCoordinates(x=getItemAtIndex_3, y=getItemAtIndex_4)
code_block_2 = CodeBlock { 20000; }
byStartPointDirectionLength = Line.ByStartPointDirectionLength(startPoint=byCoordinates, direction=byCoordinates_2, length=code_block_2)
code_block_3 = CodeBlock { "General"; 0; }
export = BoolSelector(false)
code_block_4 = CodeBlock(pass=export, data=code_block_3.out1) { pass?data:""; }
string_2 = StringInput("General")
importExcel_2 = Data.ImportExcel(file=file_from_path, sheetName=string_2)
firstItem = List.FirstItem(list=importExcel_2)
count = List.Count(list=firstItem)
code_block_5 = CodeBlock { "SubPoint"; }
is_inneredge = BoolSelector(true)
code_block_6 = CodeBlock(isInner=is_inneredge) { isInner?"InnerEdge":"OuterEdge"; }
list_create = List.Create(item0=code_block_5, item1=code_block_6)
count_2 = List.Count(list=byCoordinates)
code_block_7 = CodeBlock(cnt=count_2) { 0..cnt-1; }
select_reference_drawing = DSModelElementSelection()  # 1 picked in the model

# group: Layer Name
intersect_line_with_reference = StringInput("InnerEdge_NB")
segment_reference_line = StringInput("S-_SEG-----_E-NB")

curvesFromCADLayers = CAD.CurvesFromCADLayers(importInstance=select_reference_drawing, layerNames=intersect_line_with_reference)
removeDuplicates = Curve.RemoveDuplicates(curves=curvesFromCADLayers.Curve)
flatten = List.Flatten(list=removeDuplicates.cleanedCurves)
curvesFromCADLayers_2 = CAD.CurvesFromCADLayers(importInstance=select_reference_drawing, layerNames=segment_reference_line)
removeDuplicates_2 = Curve.RemoveDuplicates(curves=curvesFromCADLayers_2.Curve)
flatten_2 = List.Flatten(list=removeDuplicates_2.cleanedCurves@L1)
addItemToEnd = List.AddItemToEnd(item=flatten, list=flatten_2@L2)
flatten_3 = List.Flatten(list=addItemToEnd@L3)
intersectAll = Curve.IntersectAll(curves=flatten_3)
intersectAll_2 = Curve.IntersectAll(curves=flatten)
setDifference = List.SetDifference(list1=intersectAll, list2=intersectAll_2)
python_script = Python(IN[0]=setDifference)
# ---------- python_script.python (9 lines) ----------
list = IN[0]
set = []
for i in list:
	if len(i) == 1:
		set.append(i[0])
	else:
		set.append(None)

OUT = set
# ----------------------------------------
placementCurve = StringInput("PlacementCurve_NB")
curvesFromCADLayers_3 = CAD.CurvesFromCADLayers(importInstance=select_reference_drawing, layerNames=placementCurve)
removeDuplicates_3 = Curve.RemoveDuplicates(curves=curvesFromCADLayers_3.Curve)
byJoinedCurves = PolyCurve.ByJoinedCurves(curves=removeDuplicates_3.cleanedCurves)
flatten_4 = List.Flatten(list=removeDuplicates_3.cleanedCurves)
addItemToEnd_2 = List.AddItemToEnd(item=flatten_4, list=flatten_2@L2)
flatten_5 = List.Flatten(list=addItemToEnd_2@L3)
intersectAll_3 = Curve.IntersectAll(curves=flatten_5)
intersectAll_4 = Curve.IntersectAll(curves=flatten_4)
setDifference_2 = List.SetDifference(list1=intersectAll_3, list2=intersectAll_4)
flatten_6 = List.Flatten(list=setDifference_2)
parameterAtPoint = Curve.ParameterAtPoint(curve=byJoinedCurves@L1, point=flatten_6)
flatten_7 = List.Flatten(list=parameterAtPoint)
sortByKey = List.SortByKey(list=python_script, keys=flatten_7)
distanceTo = Geometry.DistanceTo(geometry=byCoordinates, other=sortByKey.sorted_list)
list_create_2 = List.Create(item0=code_block_7, item1=distanceTo)
transpose_2 = List.Transpose(lists=list_create_2)
addItemToFront = List.AddItemToFront(item=list_create, list=transpose_2)
exportExcel = Data.ExportExcel(filePath=file_path, sheetName=code_block_3.out0, startRow=code_block_4, startCol=count, data=addItemToFront)
count_3 = List.Count(list=list_create_2@L2)
code_block_8 = CodeBlock(a=count_3) { a[0]==a[1]; }
code_block_9 = CodeBlock(cond=code_block_8) { List.AllTrue(cond)==true?"Pass":"Data Index is not equal"; }
watch = Watch(code_block_9)
