# Dynamo graph Horizontal Alignment_Segment_Sub_SubPoints.dyn (Dynamo 2.3.1.11775)
# packages: bimorphNodes 3.0.3

file_path = Filename(".\Family.xlsx")
file_from_path = FileObject(path=file_path)
string = StringInput("Alignment")
importExcel = Data.ImportExcel(file=file_from_path, sheetName=string)
restOfItems = List.RestOfItems(list=importExcel)
transpose = List.Transpose(lists=restOfItems)
code_block = CodeBlock { 1; 2; 3; 4; }
getItemAtIndex = List.GetItemAtIndex(list=transpose, index=code_block.out0)
getItemAtIndex_2 = List.GetItemAtIndex(list=transpose, index=code_block.out1)
byCoordinates = Point.ByCoordinates(x=getItemAtIndex, y=getItemAtIndex_2)
getItemAtIndex_3 = List.GetItemAtIndex(list=transpose, index=code_block.out2)
getItemAtIndex_4 = List.GetItemAtIndex(list=transpose, index=code_block.out3)
byCoordinates_2 = Vector.ByCoordinates(x=getItemAtIndex_3, y=getItemAtIndex_4)
code_block_2 = CodeBlock { 20000; }
byStartPointDirectionLength = Line.ByStartPointDirectionLength(startPoint=byCoordinates, direction=byCoordinates_2, length=code_block_2)
code_block_3 = CodeBlock { "Optional"; 0; }
export = BoolSelector(true)
code_block_4 = CodeBlock(pass=export, data=code_block_3.out1) { pass?data:""; }
code_block_5 = CodeBlock { "SubPoint"; "Inner Distance to Alignment"; "Outer Distance to Alignment"; }
list_create = List.Create(item0=code_block_5.out0, item1=code_block_5.out1, item2=code_block_5.out0, item3=code_block_5.out2)
select_model_element = DSModelElementSelection()  # 1 picked in the model

# group: Layer Name
segment_reference_line = StringInput("S-_SEG-----_E-NB")
placement_alignment = StringInput("PlacementCurve_NB")

curvesFromCADLayers = CAD.CurvesFromCADLayers(importInstance=select_model_element, layerNames=segment_reference_line)
removeDuplicates = Curve.RemoveDuplicates(curves=curvesFromCADLayers.Curve)
flatten = List.Flatten(list=removeDuplicates.cleanedCurves)
curvesFromCADLayers_2 = CAD.CurvesFromCADLayers(importInstance=select_model_element, layerNames=placement_alignment)
removeDuplicates_2 = Curve.RemoveDuplicates(curves=curvesFromCADLayers_2.Curve)
flatten_2 = List.Flatten(list=removeDuplicates_2.cleanedCurves)
byJoinedCurves = PolyCurve.ByJoinedCurves(curves=flatten_2)
flatten_3 = List.Flatten(list=removeDuplicates.cleanedCurves@L1)
addItemToEnd = List.AddItemToEnd(item=flatten_2, list=flatten_3@L2)
flatten_4 = List.Flatten(list=addItemToEnd@L3)
intersectAll = Curve.IntersectAll(curves=flatten_4)
intersectAll_2 = Curve.IntersectAll(curves=flatten_2)
setDifference = List.SetDifference(list1=intersectAll, list2=intersectAll_2)
parameterAtPoint = Curve.ParameterAtPoint(curve=byJoinedCurves@L1, point=setDifference)
flatten_5 = List.Flatten(list=parameterAtPoint)
sortByKey = List.SortByKey(list=flatten, keys=flatten_5)
direction = Line.Direction(line=sortByKey.sorted_list)
angleWithVector = Vector.AngleWithVector(vector=direction, otherVector=byCoordinates_2)
code_block_6 = CodeBlock(angle=angleWithVector, lines=sortByKey.sorted_list) { angle>150?Autodesk.Curve.Reverse(lines):lines; }
startPoint = Curve.StartPoint(curve=code_block_6)
distanceTo = Geometry.DistanceTo(geometry=byCoordinates, other=startPoint)
count = List.Count(list=distanceTo)
code_block_7 = CodeBlock(cnt=count) { 0..cnt-1; }
endPoint = Curve.EndPoint(curve=code_block_6)
distanceTo_2 = Geometry.DistanceTo(geometry=byCoordinates, other=endPoint)
list_create_2 = List.Create(item0=code_block_7, item1=distanceTo, item2=code_block_7, item3=distanceTo_2)
transpose_2 = List.Transpose(lists=list_create_2)
addItemToFront = List.AddItemToFront(item=list_create, list=transpose_2)
exportExcel = Data.ExportExcel(filePath=file_path, sheetName=code_block_3.out0, startRow=code_block_4, startCol=code_block_4, data=addItemToFront)
ZAxis = Vector.ZAxis()
angleAboutAxis = Vector.AngleAboutAxis(vector=byCoordinates_2, otherVector=direction, rotationAxis=ZAxis)
count_2 = List.Count(list=list_create_2@L2)
code_block_8 = CodeBlock(a=count_2) { a[0]==a[1..3]; }
code_block_9 = CodeBlock(cond=code_block_8) { List.AllTrue(cond)==true?"Pass":"Data Index is not equal"; }
watch = Watch(code_block_9)
