# Dynamo graph Horizontal Alignment_SubFamily.dyn (Dynamo 2.3.1.11775)
# packages: bimorphNodes 3.0.3

file_path = Filename(".\Horizontal Alignment.xlsx")
code_block = CodeBlock { "PlacementPoint"; 0; }
code_block_2 = CodeBlock { "SubPoint"; "Distance to Alignment"; }
list_create = List.Create(item0=code_block_2.out0, item1=code_block_2.out1)
file_path_2 = Filename("D:\Downloads\Horizontal Alignment.xlsx")
file_from_path = FileObject(path=file_path_2)
string = StringInput("Alignment")
importExcel = Data.ImportExcel(file=file_from_path, sheetName=string)
restOfItems = List.RestOfItems(list=importExcel)
transpose = List.Transpose(lists=restOfItems)
code_block_3 = CodeBlock { 1; 2; 3; 4; }
getItemAtIndex = List.GetItemAtIndex(list=transpose, index=code_block_3.out0)
getItemAtIndex_2 = List.GetItemAtIndex(list=transpose, index=code_block_3.out1)
byCoordinates = Point.ByCoordinates(x=getItemAtIndex, y=getItemAtIndex_2)
getItemAtIndex_3 = List.GetItemAtIndex(list=transpose, index=code_block_3.out2)
getItemAtIndex_4 = List.GetItemAtIndex(list=transpose, index=code_block_3.out3)
byCoordinates_2 = Vector.ByCoordinates(x=getItemAtIndex_3, y=getItemAtIndex_4)
code_block_4 = CodeBlock { 20000; }
byStartPointDirectionLength = Line.ByStartPointDirectionLength(startPoint=byCoordinates, direction=byCoordinates_2, length=code_block_4)
select_model_element = DSModelElementSelection()  # 1 picked in the model
string_2 = StringInput("PlacementCurve_NB")
curvesFromCADLayers = CAD.CurvesFromCADLayers(importInstance=select_model_element, layerNames=string_2)
removeDuplicates = Curve.RemoveDuplicates(curves=curvesFromCADLayers.Curve)
flatten = List.Flatten(list=removeDuplicates.cleanedCurves)
code_block_5 = CodeBlock(crv1=byStartPointDirectionLength, crv2=flatten) { List.Flatten([crv1,crv2]); }
intersectAll = Curve.IntersectAll(curves=code_block_5)
intersectAll_2 = Curve.IntersectAll(curves=flatten)
setDifference = List.SetDifference(list1=intersectAll, list2=intersectAll_2)
byJoinedCurves = PolyCurve.ByJoinedCurves(curves=removeDuplicates.cleanedCurves)
parameterAtPoint = Curve.ParameterAtPoint(curve=byJoinedCurves@L1, point=setDifference)
flatten_2 = List.Flatten(list=parameterAtPoint)
sortByKey = List.SortByKey(list=setDifference, keys=flatten_2)
distanceTo = Geometry.DistanceTo(geometry=byCoordinates, other=sortByKey.sorted_list)
count = List.Count(list=distanceTo)
code_block_6 = CodeBlock(cnt=count) { 0..cnt; }
list_create_2 = List.Create(item0=code_block_6, item1=distanceTo)
transpose_2 = List.Transpose(lists=list_create_2)
addItemToFront = List.AddItemToFront(item=list_create, list=transpose_2)
exportExcel = Data.ExportExcel(filePath=file_path, sheetName=code_block.out0, startRow=code_block.out1, startCol=code_block.out1, data=addItemToFront)
