# Dynamo graph Horizontal Alignment_Subgeometry.dyn (Dynamo 2.3.1.11775)
# packages: bimorphNodes 3.0.3

file_path = Filename("D:\Downloads\Horizontal Alignment.xlsx")
file_from_path = FileObject(path=file_path)
string = StringInput("Alignment")
importExcel = Data.ImportExcel(file=file_from_path, sheetName=string)
restOfItems = List.RestOfItems(list=importExcel)
transpose = List.Transpose(lists=restOfItems)
code_block = CodeBlock { 1; 2; 3; 4; }
getItemAtIndex = List.GetItemAtIndex(list=transpose, index=code_block.out0)
getItemAtIndex_2 = List.GetItemAtIndex(list=transpose, index=code_block.out1)
byCoordinates = Point.ByCoordinates(x=getItemAtIndex, y=getItemAtIndex_2)
getItemAtIndex_3 = List.GetItemAtIndex(list=transpose, index=code_block.out2)
getItemAtIndex_4 = List.GetItemAtIndex(list=transpose, index=code_block.out3)
byCoordinates_2 = Vector.ByCoordinates(x=getItemAtIndex_3, y=getItemAtIndex_4)
code_block_2 = CodeBlock { 20000; }
byStartPointDirectionLength = Line.ByStartPointDirectionLength(startPoint=byCoordinates, direction=byCoordinates_2, length=code_block_2)
file_path_2 = Filename(".\Horizontal Alignment.xlsx")
code_block_3 = CodeBlock { "Structure Edge Point"; 0; }
code_block_4 = CodeBlock { "SubPoint"; "Inner Distance to Alignment"; "Outer Distance to Alignment"; }
list_create = List.Create(item0=code_block_4.out0, item1=code_block_4.out1, item2=code_block_4.out2)
select_model_element = DSModelElementSelection()  # 1 picked in the model
string_2 = StringInput("S-_SEG-----_E-NB")
curvesFromCADLayers = CAD.CurvesFromCADLayers(importInstance=select_model_element, layerNames=string_2)
removeDuplicates = Curve.RemoveDuplicates(curves=curvesFromCADLayers.Curve)
flatten = List.Flatten(list=removeDuplicates.cleanedCurves)
string_3 = StringInput("PlacementCurve_NB")
curvesFromCADLayers_2 = CAD.CurvesFromCADLayers(importInstance=select_model_element, layerNames=string_3)
removeDuplicates_2 = Curve.RemoveDuplicates(curves=curvesFromCADLayers_2.Curve)
flatten_2 = List.Flatten(list=removeDuplicates_2.cleanedCurves)
byJoinedCurves = PolyCurve.ByJoinedCurves(curves=flatten_2)
flatten_3 = List.Flatten(list=removeDuplicates.cleanedCurves@L1)
addItemToEnd = List.AddItemToEnd(item=flatten_2, list=flatten_3@L2)
flatten_4 = List.Flatten(list=addItemToEnd@L3)
intersectAll = Curve.IntersectAll(curves=flatten_4)
intersectAll_2 = Curve.IntersectAll(curves=flatten_2)
setDifference = List.SetDifference(list1=intersectAll, list2=intersectAll_2)
parameterAtPoint = Curve.ParameterAtPoint(curve=byJoinedCurves@L1, point=setDifference)
flatten_5 = List.Flatten(list=parameterAtPoint)
sortByKey = List.SortByKey(list=flatten, keys=flatten_5)
direction = Line.Direction(line=sortByKey.sorted_list)
angleWithVector = Vector.AngleWithVector(vector=direction, otherVector=byCoordinates_2)
code_block_5 = CodeBlock(angle=angleWithVector, lines=sortByKey.sorted_list) { angle>150?Autodesk.Curve.Reverse(lines):lines; }
startPoint = Curve.StartPoint(curve=code_block_5)
distanceTo = Geometry.DistanceTo(geometry=byCoordinates, other=startPoint)
count = List.Count(list=distanceTo)
code_block_6 = CodeBlock(cnt=count) { 0..cnt; }
endPoint = Curve.EndPoint(curve=code_block_5)
distanceTo_2 = Geometry.DistanceTo(geometry=byCoordinates, other=endPoint)
list_create_2 = List.Create(item0=code_block_6, item1=distanceTo, item2=distanceTo_2)
transpose_2 = List.Transpose(lists=list_create_2)
addItemToFront = List.AddItemToFront(item=list_create, list=transpose_2)
exportExcel = Data.ExportExcel(filePath=file_path_2, sheetName=code_block_3.out0, startRow=code_block_3.out1, startCol=code_block_3.out1, data=addItemToFront)
ZAxis = Vector.ZAxis()
angleAboutAxis = Vector.AngleAboutAxis(vector=byCoordinates_2, otherVector=direction, rotationAxis=ZAxis)
