# Dynamo graph SortCurves.DYN "SortCurves.DYN" (Dynamo 2.3.2.15696)

select_model_elements = DSModelElementsSelection()  # 27 picked in the model
code_block = CodeBlock(a=select_model_elements) { List.Flatten(a.Curves); }
byJoinedCurves = PolyCurve.ByJoinedCurves(curves=code_block)
curves = PolyCurve.Curves(polyCurve=byJoinedCurves)
byCurve = ModelCurve.ByCurve(curve=curves)
