# Dynamo graph TopoEditSample.dyn (Dynamo 2.3.1.11775)

select_edge = DSEdgeSelection()  # 1 picked in the model
code_block = CodeBlock { 0..1..#10; }
pointAtParameter = Curve.PointAtParameter(curve=select_edge, param=code_block)
select_topo = DSModelElementSelection()  # 1 picked in the model
points = Topography.Points(topography=select_topo)
closestPointTo = Geometry.ClosestPointTo(geometry=select_edge, other=points)
flatten = List.Flatten(list=closestPointTo)
flatten_2 = List.Flatten(list=closestPointTo)
byStartPointEndPoint = Line.ByStartPointEndPoint(startPoint=flatten_2, endPoint=points)
isNull = Object.IsNull(obj=byStartPointEndPoint)

# group: Closest
filterByBoolMask = List.FilterByBoolMask(list=flatten, mask=isNull)

filterByBoolMask_2 = List.FilterByBoolMask(list=byStartPointEndPoint, mask=isNull)
direction = Line.Direction(line=filterByBoolMask_2.out)
normalized = Vector.Normalized(vector=direction)
code_block_2 = CodeBlock(a=normalized) { Math.Abs(a.Z)>0.9; }
boolean = BoolSelector(true)
allIndicesOf = List.AllIndicesOf(list=code_block_2, item=boolean)

# group: To be added
getItemAtIndex = List.GetItemAtIndex(list=filterByBoolMask.out, index=allIndicesOf)

code_block_3 = CodeBlock { -10000; }
translate = Geometry.Translate(geometry=points, zTranslation=code_block_3)
ZAxis = Vector.ZAxis()
project = Point.Project(point=translate, baseGeometry=select_edge, projectionDirection=ZAxis)
isEmpty = List.IsEmpty(list=project@L2)
filterByBoolMask_3 = List.FilterByBoolMask(list=project, mask=isEmpty)

# group: Projected
flatten_3 = List.Flatten(list=filterByBoolMask_3.out)

closest_or_projected_point = BoolSelector(false)
code_block_4 = CodeBlock(trueval=getItemAtIndex, falseval=flatten_3, test=closest_or_projected_point) { result = [trueval, falseval]; result[test ? 0 : 1]; }
append_or_move = BoolSelector(true)
code_block_5 = CodeBlock(trueval=pointAtParameter, falseval=code_block_4.out1, test=append_or_move) { result = [trueval, falseval]; result[test ? 0 : 1]; }
flatten_4 = List.Flatten(list=points)

# group: Existing
filterByBoolMask_4 = List.FilterByBoolMask(list=flatten_4, mask=isNull)

# group: To be removed
getItemAtIndex_2 = List.GetItemAtIndex(list=filterByBoolMask_4.out, index=allIndicesOf)

filterByBoolMask_5 = List.FilterByBoolMask(list=points, mask=isEmpty)

# group: Existing
flatten_5 = List.Flatten(list=filterByBoolMask_5.out)

code_block_6 = CodeBlock(trueval=getItemAtIndex_2, falseval=flatten_5, test=closest_or_projected_point) { result = [trueval, falseval]; result[test ? 0 : 1]; }
isNull_2 = Object.IsNull(obj=code_block_6.out1)
firstItem = List.FirstItem(list=isNull_2)
code_block_7 = CodeBlock(trueval=code_block_4.out1, falseval=code_block_6.out1, test=firstItem) { result = [trueval, falseval]; result[test ? 0 : 1]; }
flatten_6 = List.Flatten(list=code_block_7.out1)
python_script = Python(IN[0]=code_block_5.out1, IN[1]=flatten_6, IN[2]=select_topo, IN[3]=append_or_move)
# ---------- python_script.python (89 lines) ----------
#Update Topo(Append or Move Point)
#Created By DY Lim - dylim@tssni.com
#Inspired By Karam Baki : karam@aecedx.com

import clr
clr.AddReference('ProtoGeometry')
from Autodesk.DesignScript import Geometry as dg

# EXTENSION Enable ToDSType
clr.AddReference('RevitNodes')
import Revit
clr.ImportExtensions(Revit.Elements)

# Enable Revit Elements
from Revit.Elements import *

# EXTENSION Enable Geometry Conversion Methods
clr.ImportExtensions(Revit.GeometryConversion)

# Enable Revit API
clr.AddReference('RevitAPI')
from Autodesk.Revit.DB import *
import Autodesk.Revit.DB
# Enable DocumentManager and TransactionManager
clr.AddReference('RevitServices')
from RevitServices.Persistence import DocumentManager
from RevitServices.Transactions import TransactionManager

# Enable ICollection List Translate
clr.AddReference("System")
import System.Collections.Generic
from System.Collections.Generic import List
doc = DocumentManager.Instance.CurrentDBDocument
uidoc = DocumentManager.Instance.CurrentUIApplication.ActiveUIDocument
uiapp = DocumentManager.Instance.CurrentUIApplication
app = uiapp.Application

class WarnSwallow(IFailuresPreprocessor):
	def PreprocessFailures(self, failuresAccessor):
		failuresAccessor.DeleteAllWarnings()
		return FailureProcessingResult.Continue

def append_point(pts_added,topoid):
    Revit.Transaction.Transaction.End(doc)
    editsession.Start(topoid)
    TransactionManager.Instance.EnsureInTransaction(doc)
    topo.AddPoints(pts_added)
    TransactionManager.Instance.ForceCloseTransaction()
    editsession.Commit(failproc)

def remove_point(pts_removed,topoid):
    Revit.Transaction.Transaction.End(doc)
    editsession.Start(topoid)
    TransactionManager.Instance.EnsureInTransaction(doc)
    topo.DeletePoints(pts_remove)
    TransactionManager.Instance.ForceCloseTransaction()
    editsession.Commit(failproc)


#####################################################################
#Data Input
dataEnteringNode = IN
# Use UnwrapElement(IN[0]) When Translating From Dynamo to Revit
pts_new = [i.ToXyz() for i in UnwrapElement(IN[0])]
pts_remove = [i.ToXyz() for i in UnwrapElement(IN[1])]
topo = UnwrapElement(IN[2])
append_or_move=IN[3]
#Data Input
#####################################################################

#For Topo Edit Scope
failproc = WarnSwallow()
editsession = Architecture.TopographyEditScope(doc,"Main Session")
editsessioncl = Architecture.TopographyEditScope(doc,"Clean Up Session")
topo_id=topo.Id

#append point if true or move point to closest edge point
if append_or_move == True:
    append_point(pts_new,topo_id)
elif append_or_move == False:
	remove_point(pts_remove,topo_id)
	append_point(pts_new,topo_id)


###################
#Data Output
OUT = topo
#Data Output
###################
# ----------------------------------------
watch = Watch(code_block_5.out1)
